# Grasshopper definition GRID_DERIVATION_FROM_BUILTAREA_V1.gh (Grasshopper 1.0.8)
# plug-ins: Bifocals, eleFront

curve = Curve(flatten(<curve referenced from the Rhino model>))
curve_2 = Curve(flatten([<curve referenced from the Rhino model> x4]))

# ---- group: CURVE 3 SHAPED CURVE
# Boundary Curve
curve_3 = Curve(<curve referenced from the Rhino model>)

# ----
# Boundary Curve
curve_4 = Curve(<curve referenced from the Rhino model>)
curve_5 = Curve([<curve referenced from the Rhino model> x7])
# Interior Shafts,
# Openings,
# Stair Boundary Curve
# 
# -Columnless areas
curve_6 = Curve([<curve referenced from the Rhino model> x3])
# TILTED LAYOUT
# Boundary Curve
# Interior Shafts,
# Openings,
# Stair Boundary Curve
# 
# -Columnless areas
curve_7 = Curve(<curve referenced from the Rhino model>)
curve_8 = Curve([<curve referenced from the Rhino model> x8])
curve_9 = Curve([<curve referenced from the Rhino model> x4])

# ---- group: CURVE CIRCULATIONS
# Interior Shafts,
# Openings,
# Stair Boundary Curve
# 
# -Columnless areas
curve_10 = Curve([<curve referenced from the Rhino model> x2])

# ---- group: CURVE 3 SHAFT LISTS
curve_11 = Curve([<curve referenced from the Rhino model> x12])

# ----
_3_01_chopped_built_area_boundary = EleFrontDataDescription(curve_4, ShiftDepth=0, isNameSet=True)

# ---- group: CURVE 2 30X40 M
# Curve Collection
curve_12 = Curve(<curve referenced from the Rhino model>)

# ----
_3_01_internal_boundary_curves = EleFrontDataDescription(curve_5, ShiftDepth=0, isNameSet=True)
_3_02_internal_boundary_curves = EleFrontDataDescription(curve_6, ShiftDepth=0, isNameSet=True)
_3_02_tilted_built_area_boundary = EleFrontDataDescription(curve_7, ShiftDepth=0, isNameSet=True)
_3_02_internal_boundary_curves_2 = EleFrontDataDescription(curve_8, ShiftDepth=0, isNameSet=True)
_3_03_internal_boundary_curves = EleFrontDataDescription(curve_9, ShiftDepth=0, isNameSet=True)

# ---- group: CURVE 2 SHAFTS LIFTS
curve_13 = Curve([<curve referenced from the Rhino model> x7])

# ----
# LINEAR LAYOUT
curve_14 = Curve(<curve referenced from the Rhino model>)
surface = Surface(curve_3)
data = Data(_3_02_tilted_built_area_boundary)
surface_split = SurfaceSplit(Surface=surface, Curves=[curve_11, curve_10])
merge = Merge(Data1=_3_01_internal_boundary_curves, Data2=_3_02_internal_boundary_curves)
data_2 = Data(_3_02_internal_boundary_curves_2)
data_3 = Data(_3_03_internal_boundary_curves)
surface_2 = Surface(curve_10)
custom_preview = CustomPreview(Geometry=surface_2, Material=ColourSwatch(SwatchColor=RGB(42, 87, 87)))
surface_3 = Surface(_3_01_chopped_built_area_boundary)
merge_2 = Merge(Data1=data_2, Data2=data_3)
surface_4 = Surface(data)
surface_5 = Surface(curve_11)
# Find the Solved Splitted Surface
# each time when designs are changed
# ( !!IMPORTANT NOTE!!- Please look into this each
#  time designs are been updated and toggle slider
# to find the correct solved surface )
number_slider = Slider(10, range=0..100)
surface_split_2 = SurfaceSplit(Surface=surface_3, Curves=merge)
custom_preview_2 = CustomPreview(Geometry=surface_5, Material=ColourSwatch(SwatchColor=RGB(100, 196, 196)))
surface_6 = Surface(_3_02_internal_boundary_curves)
bounding_box = BoundingBox(Content=curve_3, Plane=PlaneXY(0, 0, 0))  # -> Box, Box_2
custom_preview_3 = CustomPreview(Geometry=surface_6, Material=ColourSwatch(SwatchColor=RGB(42, 87, 87)))
surface_split_3 = SurfaceSplit(Surface=surface_4, Curves=merge_2)
surface_7 = Surface(data_3)
list_item = ListItem(List=surface_split, Index=number_slider, Wrap=True)
custom_preview_4 = CustomPreview(Geometry=surface_7, Material=ColourSwatch(SwatchColor=RGB(42, 87, 87)))
deconstruct_brep = DeconstructBrep(Brep=bounding_box.Box)  # -> Faces, Edges, Vertices
surface_8 = Surface(_3_01_internal_boundary_curves)
# Find the Solved Splitted Surface
# each time when designs are changed
# ( !!IMPORTANT NOTE!!- Please look into this each
#  time designs are been updated and toggle slider
# to find the correct solved surface )
number_slider_2 = Slider(7, range=0..100)
custom_preview_5 = CustomPreview(Geometry=surface_8, Material=ColourSwatch(SwatchColor=RGB(100, 196, 196)))
surface_9 = Surface(data_2)
bounding_box_2 = BoundingBox(Content=_3_01_chopped_built_area_boundary, Plane=PlaneXY(0, 0, 0))  # -> Box, Box_2
# Find the Solved Splitted Surface
# each time when designs are changed
# ( !!IMPORTANT NOTE!!- Please look into this each
#  time designs are been updated and toggle slider
# to find the correct solved surface )
number_slider_3 = Slider(12, range=0..100)
custom_preview_6 = CustomPreview(Geometry=surface_9, Material=ColourSwatch(SwatchColor=RGB(100, 196, 196)))
list_item_2 = ListItem(List=surface_split_2, Index=number_slider_2, Wrap=True)
curve_15 = Curve(deconstruct_brep.Edges)
surface_10 = Surface(list_item)
bounding_box_3 = BoundingBox(Content=data, Plane=PlaneXY(0, 0, 0))  # -> Box, Box_2
list_item_3 = ListItem(List=surface_split_3, Index=number_slider_3, Wrap=True)
deconstruct_brep_2 = DeconstructBrep(Brep=bounding_box_2.Box)  # -> Faces, Edges, Vertices
deconstruct_brep_3 = DeconstructBrep(Brep=bounding_box_3.Box)  # -> Faces, Edges, Vertices
curve_16 = Curve(deconstruct_brep_2.Edges)
surface_11 = Surface(list_item_2)
curve_17 = Curve(deconstruct_brep_3.Edges)
curve_18 = Curve(data)
surface_12 = Surface(list_item_3)
bounded_shape = EleFrontDataDescription(curve_15, ShiftDepth=0, isNameSet=True)
solved_shape = EleFrontDataDescription(surface_10, ShiftDepth=0, isNameSet=True)
surface_13 = Surface(solved_shape)
custom_preview_7 = CustomPreview(Geometry=surface_13, Material=ColourSwatch(SwatchColor=RGB(21, 133, 133)))
data_4 = Data(curve_18)
bounded_shape_2 = EleFrontDataDescription(curve_16, ShiftDepth=0, isNameSet=True)
solved_shape_2 = EleFrontDataDescription(surface_11, ShiftDepth=0, isNameSet=True)
surface_14 = Surface(solved_shape_2)
custom_preview_8 = CustomPreview(Geometry=surface_14, Material=ColourSwatch(SwatchColor=RGB(21, 133, 133)))
bounded_shape_3 = EleFrontDataDescription(data_4, ShiftDepth=0, isNameSet=True)
solved_shape_3 = EleFrontDataDescription(surface_12, ShiftDepth=0, isNameSet=True)
surface_15 = Surface(solved_shape_3)
custom_preview_9 = CustomPreview(Geometry=surface_15, Material=ColourSwatch(SwatchColor=RGB(21, 133, 133)))
# Property Boundary Internal Even Offset
join_curves = JoinCurves(Curves=bounded_shape_2, Preserve=False)  # -> flatten(Curves)
# Property Boundary Internal Even Offset
join_curves_2 = JoinCurves(Curves=bounded_shape_3, Preserve=False)  # -> flatten(Curves)
# GRID TYPE SOLVER 2
number_slider_4 = Slider(0, range=0..10)
# GRID TYPE SOLVER 2
explode = Explode(Curve=bounded_shape_3, Recursive=True)  # -> Segments, Vertices
explode_2 = Explode(Curve=bounded_shape_3, Recursive=True)  # -> Segments, Vertices
grid_span_x = Slider(4.5, range=0..20)

# ----
# GRID TYPE SOLVER 2
number_slider_5 = Slider(0, range=0..10)
# No Initial Offsets to start
# chain of grids across X and Y
# Horizontal Axis Curve
list_item_4 = ListItem(List=bounded_shape, Index=number_slider_5, Wrap=True)
end_points = EndPoints(Curve=list_item_4)  # -> Start, End
unit_x = UnitX(Factor=1)
point = Point(end_points.Start)
contour = Contour(Shape=solved_shape, Point=point, Direction=unit_x, Distance=grid_span_x)  # -> reparameterize(simplify(Contours))

# ----
# GRID TYPE SOLVER 3
# Horizontal Axis Curve /  A Fixed distance
curve_19 = Curve(list_item_4)

grid_span_x_2 = Slider(6, range=0..20)
length = Length(Curve=curve_19)
division = Division(A=length, B=grid_span_x_2)
# Standard Even Interval Offsets across X and Y
divide_curve = DivideCurve(Curve=curve_19, Count=division, Kinks=False)  # -> Points, Tangents, Parameters

grid_span_y = Slider(6, range=0..20)

# ----
# Vertical Axis Curve
list_item_5 = ListItem(List=bounded_shape, Index=Slider(3, range=0..10), Wrap=True)
end_points_2 = EndPoints(Curve=list_item_5)  # -> Start, End
unit_y = UnitY(Factor=1)
point_2 = Point(end_points_2.Start)
contour_2 = Contour(Shape=solved_shape, Point=point_2, Direction=unit_y, Distance=grid_span_y)  # -> reparameterize(simplify(Contours))

# ----
# Vertical Axis Curve /  A Fixed distance
curve_20 = Curve(list_item_5)

grid_span_x_3 = Slider(6, range=0..20)
length_2 = Length(Curve=curve_19)
division_2 = Division(A=length_2, B=grid_span_x_3)
divide_curve_2 = DivideCurve(Curve=curve_20, Count=division_2, Kinks=False)  # -> Points, Tangents, Parameters

unit_y_2 = UnitY(Factor=1)
# No Initial Offsets to start
# chain of grids across X and Y
# Horizontal Axis Curve
list_item_6 = ListItem(List=bounded_shape_2, Index=number_slider_4, Wrap=True)
unit_x_2 = UnitX(Factor=1)
# Vertical Axis Curve
list_item_7 = ListItem(List=bounded_shape_2, Index=Slider(3, range=0..10), Wrap=True)
# Horizontal Axis Curve
list_item_8 = ListItem(List=explode.Segments, Index=Slider(3, range=0..10), Wrap=True)
# Vertical Axis Curve
list_item_9 = ListItem(List=explode_2.Segments, Index=Slider(6, range=0..10), Wrap=True)
end_points_3 = EndPoints(Curve=list_item_6)  # -> Start, End
end_points_4 = EndPoints(Curve=list_item_7)  # -> Start, End
grid_span_x_4 = Slider(4.5, range=0..20)
grid_span_y_2 = Slider(6, range=0..20)
# No Initial Offsets to start
# chain of grids across X and Y
end_points_5 = EndPoints(Curve=list_item_8)  # -> Start, End
line_sdl = LineSDL(Start=divide_curve.Points, Direction=unit_y_2, Length=length_2)
line_sdl_2 = LineSDL(Start=divide_curve_2.Points, Direction=unit_x_2, Length=length)
end_points_6 = EndPoints(Curve=list_item_9)  # -> Start, End
vector_2pt = Vector2Pt(PointA=end_points_6.Start, PointB=end_points_6.End, Unitize=False)  # -> Vector, Length
unit_x_3 = UnitX(Factor=1)
grid_span_y_3 = Slider(6, range=0..20)
unit_y_3 = UnitY(Factor=1)
vector_2pt_2 = Vector2Pt(PointA=end_points_5.Start, PointB=end_points_5.End, Unitize=False)  # -> Vector, Length
grid_span_x_5 = Slider(4.5, range=0..20)
unit_x_4 = UnitX(Factor=1)
unit_vector = UnitVector(Vector=vector_2pt.Vector)
point_3 = Point(end_points_3.Start)
grid_span_x_6 = Slider(5, range=0..20)
grid_span_y_4 = Slider(5, range=0..20)
unit_vector_2 = UnitVector(Vector=vector_2pt_2.Vector)
grid_extension_x_y_directions = Slider(4, range=0..20)
point_4 = Point(end_points_4.Start)
unit_y_4 = UnitY(Factor=1)
point_5 = Point(end_points_5.Start)
contour_3 = Contour(Shape=solved_shape_2, Point=point_3, Direction=unit_x_3, Distance=grid_span_x_4)  # -> reparameterize(simplify(Contours))
point_6 = Point(end_points_6.Start)
contour_4 = Contour(Shape=solved_shape_2, Point=point_4, Direction=unit_y_3, Distance=grid_span_y_2)  # -> reparameterize(simplify(Contours))
unit_y_5 = UnitY(Factor=1)
contour_5 = Contour(Shape=solved_shape_3, Point=point_6, Direction=unit_vector, Distance=grid_span_y_3)  # -> reparameterize(simplify(Contours))
contour_6 = Contour(Shape=solved_shape_3, Point=point_5, Direction=unit_vector_2, Distance=grid_span_x_5)  # -> reparameterize(simplify(Contours))
curve_curve = CurveCurve(CurveA=flatten(contour), CurveB=graft(contour_2))  # -> Points, ParamsA, ParamsB
grid_span_x_7 = Slider(8, range=0..20)
grid_span_y_5 = Slider(5, range=0..20)
grid_extension_x_y_directions_2 = Slider(4, range=0..20)
grid_span_x_8 = Slider(5, range=0..20)
grid_span_y_6 = Slider(5, range=0..20)
grid_extension_x_y_directions_3 = Slider(4, range=0..20)
x_start_end = Slider(0.3, range=0..5)
y_start_end = Slider(0.4, range=0..5)

# ----
# Extended Lines
extend_curve = ExtendCurve(Curve=contour, Type=0, Start=grid_extension_x_y_directions, End=grid_extension_x_y_directions)
extend_curve_2 = ExtendCurve(Curve=contour_2, Type=0, Start=grid_extension_x_y_directions, End=grid_extension_x_y_directions)

colour_swatch = ColourSwatch(SwatchColor=RGB(0, 0, 0))
curve_curve_2 = CurveCurve(CurveA=flatten(contour_3), CurveB=graft(contour_4))  # -> Points, ParamsA, ParamsB
colour_swatch_2 = ColourSwatch(SwatchColor=RGB(255, 0, 0))
# Internal Offset Value
boundary_internal_offset = Slider(2.85, range=0..20)

# ----
# Property Boundary Internal Even Offset
join_curves_3 = JoinCurves(Curves=bounded_shape, Preserve=False)  # -> flatten(Curves)
negative = Negative(Value=boundary_internal_offset)
offset_curve = OffsetCurve(Curve=join_curves_3, Distance=negative, Corners=1)
# GRID TYPE SOLVER 1
explode_3 = Explode(Curve=offset_curve, Recursive=True)  # -> Segments, Vertices

panel = Panel(boundary_internal_offset)

# ----
# Horizontal Axis Curve With a specific offset from the start point
list_item_10 = ListItem(List=explode_3.Segments, Index=Slider(1, range=0..10), Wrap=True)
# Specific Initial Offsets to start
# chain of grids across X and Y
end_points_7 = EndPoints(Curve=list_item_10)  # -> Start, End
unit_x_5 = UnitX(Factor=1)
point_7 = Point(end_points_7.Start)
contour_7 = Contour(Shape=solved_shape, Point=point_7, Direction=unit_x_5, Distance=grid_span_x_6)

# ----
# Vertical Axis Curve With a specific offset from the start point
list_item_11 = ListItem(List=explode_3.Segments, Index=Slider(4, range=0..10), Wrap=True)
end_points_8 = EndPoints(Curve=list_item_11)  # -> Start, End
unit_y_6 = UnitY(Factor=1)
point_8 = Point(end_points_8.End)
contour_8 = Contour(Shape=solved_shape, Point=point_8, Direction=unit_y_6, Distance=grid_span_y_4)

curve_curve_3 = CurveCurve(CurveA=flatten(contour_7), CurveB=graft(contour_8))  # -> Points, ParamsA, ParamsB

# ----
# Extended Lines
extend_curve_3 = ExtendCurve(Curve=contour_7, Type=0, Start=grid_extension_x_y_directions, End=grid_extension_x_y_directions)
extend_curve_4 = ExtendCurve(Curve=contour_8, Type=0, Start=grid_extension_x_y_directions, End=grid_extension_x_y_directions)

curve_curve_4 = CurveCurve(CurveA=flatten(contour_6), CurveB=graft(contour_5))  # -> Points, ParamsA, ParamsB
colour_swatch_3 = ColourSwatch(SwatchColor=RGB(0, 150, 150))
evenly_distributed_rectangle_from_origin = EvenlyDistributedRectangleFromOrigin(x_start=x_start_end, y_start_2=x_start_end, radius=Slider(0.04, range=0..5), y_start=y_start_end, y_end=y_start_end)

pipe = Pipe(Curve=[list_item_10, list_item_11], Radius=Slider(0.19, range=0..3), Caps=2)
custom_preview_10 = CustomPreview(Geometry=curve_curve_3.Points, Material=colour_swatch)
custom_preview_11 = CustomPreview(Geometry=pipe, Material=colour_swatch)
custom_curve_preview = CustomCurvePreview(Curve=[extend_curve_3, extend_curve_4], Linetype=<geometry referenced from the Rhino model>, Colour=colour_swatch)

pipe_2 = Pipe(Curve=[list_item_4, list_item_5], Radius=Slider(0.13, range=0..3), Caps=2)
custom_preview_12 = CustomPreview(Geometry=pipe_2, Material=colour_swatch_2)
custom_preview_13 = CustomPreview(Geometry=curve_curve.Points, Material=colour_swatch_2)
custom_curve_preview_2 = CustomCurvePreview(Curve=[extend_curve, extend_curve_2], Linetype=<geometry referenced from the Rhino model>, Colour=colour_swatch_2)

# ----
# Extended Lines
extend_curve_5 = ExtendCurve(Curve=contour_3, Type=0, Start=grid_extension_x_y_directions_2, End=grid_extension_x_y_directions_2)
extend_curve_6 = ExtendCurve(Curve=contour_4, Type=0, Start=grid_extension_x_y_directions_2, End=grid_extension_x_y_directions_2)

custom_preview_14 = CustomPreview(Geometry=divide_curve_2.Points, Material=colour_swatch_3)
custom_curve_preview_3 = CustomCurvePreview(Curve=line_sdl, Linetype=<geometry referenced from the Rhino model>, Colour=colour_swatch_3)
custom_curve_preview_4 = CustomCurvePreview(Curve=line_sdl_2, Linetype=<geometry referenced from the Rhino model>, Colour=colour_swatch_3)
custom_preview_15 = CustomPreview(Geometry=divide_curve.Points, Material=colour_swatch_3)

colour_swatch_4 = ColourSwatch(SwatchColor=RGB(0, 0, 0))
ruled_surface = RuledSurface(CurveA=curve_3)
colour_swatch_5 = ColourSwatch(SwatchColor=RGB(255, 0, 0))
extend_curve_7 = ExtendCurve(Curve=contour_6, Type=0, Start=grid_extension_x_y_directions_3, End=grid_extension_x_y_directions_3)
extend_curve_8 = ExtendCurve(Curve=contour_5, Type=0, Start=grid_extension_x_y_directions_3, End=grid_extension_x_y_directions_3)
custom_preview_16 = CustomPreview(
    Geometry=ruled_surface,
    Material={diffuse=RGB(221, 160, 221), emission=RGB(66, 48, 66), shine=0.5, specular=RGB(255, 255, 255), transparency=0})
# Internal Offset Value
boundary_internal_offset_2 = Slider(2.85, range=0..20)
negative_2 = Negative(Value=boundary_internal_offset_2)
panel_2 = Panel(boundary_internal_offset_2)
offset_curve_2 = OffsetCurve(Curve=join_curves, Distance=negative_2, Corners=1)
# GRID TYPE SOLVER 1
explode_4 = Explode(Curve=offset_curve_2, Recursive=True)  # -> Segments, Vertices
# Horizontal Axis Curve With a specific offset from the start point
list_item_12 = ListItem(List=explode_4.Segments, Index=Slider(1, range=0..10), Wrap=True)
# Vertical Axis Curve With a specific offset from the start point
list_item_13 = ListItem(List=explode_4.Segments, Index=Slider(4, range=0..10), Wrap=True)
# Specific Initial Offsets to start
# chain of grids across X and Y
end_points_9 = EndPoints(Curve=list_item_12)  # -> Start, End
end_points_10 = EndPoints(Curve=list_item_13)  # -> Start, End
point_9 = Point(end_points_9.Start)
point_10 = Point(end_points_10.End)
contour_9 = Contour(Shape=solved_shape_2, Point=point_9, Direction=unit_x_4, Distance=grid_span_x_7)
contour_10 = Contour(Shape=solved_shape_2, Point=point_10, Direction=unit_y_4, Distance=grid_span_y_5)
curve_curve_5 = CurveCurve(CurveA=flatten(contour_9), CurveB=graft(contour_10))  # -> Points, ParamsA, ParamsB
# Extended Lines
extend_curve_9 = ExtendCurve(Curve=contour_9, Type=0, Start=grid_extension_x_y_directions_2, End=grid_extension_x_y_directions_2)
extend_curve_10 = ExtendCurve(Curve=contour_10, Type=0, Start=grid_extension_x_y_directions_2, End=grid_extension_x_y_directions_2)
colour_swatch_6 = ColourSwatch(SwatchColor=RGB(0, 0, 0))
colour_swatch_7 = ColourSwatch(SwatchColor=RGB(255, 0, 0))
surface_16 = Surface(evenly_distributed_rectangle_from_origin)
boundary_internal_offset_3 = Slider(2.85, range=0..20)
negative_3 = Negative(Value=boundary_internal_offset_3)
panel_3 = Panel(boundary_internal_offset_3)
offset_curve_3 = OffsetCurve(Curve=join_curves_2, Distance=negative_3, Corners=1)
# GRID TYPE SOLVER 1
explode_5 = Explode(Curve=offset_curve_3, Recursive=True)  # -> Segments, Vertices
# Horizontal Axis Curve With a specific offset from the start point
list_item_14 = ListItem(List=explode_5.Segments, Index=Slider(3, range=0..10), Wrap=True)
# Vertical Axis Curve With a specific offset from the start point
list_item_15 = ListItem(List=explode_5.Segments, Index=Slider(6, range=0..10), Wrap=True)
end_points_11 = EndPoints(Curve=list_item_14)  # -> Start, End
end_points_12 = EndPoints(Curve=list_item_15)  # -> Start, End
vector_2pt_3 = Vector2Pt(PointA=end_points_12.Start, PointB=end_points_12.End, Unitize=False)  # -> Vector, Length
vector_2pt_4 = Vector2Pt(PointA=end_points_11.Start, PointB=end_points_11.End, Unitize=False)  # -> Vector, Length
unit_vector_3 = UnitVector(Vector=vector_2pt_4.Vector)
unit_vector_4 = UnitVector(Vector=vector_2pt_3.Vector)
point_11 = Point(end_points_11.Start)
point_12 = Point(end_points_12.End)
contour_11 = Contour(Shape=solved_shape_3, Point=point_11, Direction=unit_vector_3, Distance=grid_span_x_8)
contour_12 = Contour(Shape=solved_shape_3, Point=point_12, Direction=unit_vector_4, Distance=grid_span_y_6)
curve_curve_6 = CurveCurve(CurveA=flatten(contour_11), CurveB=graft(contour_12))  # -> Points, ParamsA, ParamsB
extend_curve_11 = ExtendCurve(Curve=contour_11, Type=0, Start=grid_extension_x_y_directions_3, End=grid_extension_x_y_directions_3)
extend_curve_12 = ExtendCurve(Curve=contour_12, Type=0, Start=grid_extension_x_y_directions_3, End=grid_extension_x_y_directions_3)

pipe_3 = Pipe(Curve=[list_item_12, list_item_13], Radius=Slider(0.19, range=0..3), Caps=2)
custom_preview_17 = CustomPreview(Geometry=curve_curve_5.Points, Material=colour_swatch_4)
custom_preview_18 = CustomPreview(Geometry=pipe_3, Material=colour_swatch_4)
custom_curve_preview_5 = CustomCurvePreview(Curve=[extend_curve_9, extend_curve_10], Linetype=<geometry referenced from the Rhino model>, Colour=colour_swatch_4)

pipe_4 = Pipe(Curve=[list_item_6, list_item_7], Radius=Slider(0.13, range=0..3), Caps=2)
custom_preview_19 = CustomPreview(Geometry=pipe_4, Material=colour_swatch_5)
custom_preview_20 = CustomPreview(Geometry=curve_curve_2.Points, Material=colour_swatch_5)
custom_curve_preview_6 = CustomCurvePreview(Curve=[extend_curve_5, extend_curve_6], Linetype=<geometry referenced from the Rhino model>, Colour=colour_swatch_5)

ruled_surface_2 = RuledSurface(CurveA=_3_01_chopped_built_area_boundary)

pipe_5 = Pipe(Curve=[list_item_14, list_item_15], Radius=Slider(0.08, range=0..3), Caps=2)
custom_preview_21 = CustomPreview(Geometry=curve_curve_6.Points, Material=colour_swatch_6)
custom_curve_preview_7 = CustomCurvePreview(Curve=[extend_curve_11, extend_curve_12], Linetype=<geometry referenced from the Rhino model>, Colour=colour_swatch_6)
custom_preview_22 = CustomPreview(Geometry=pipe_5, Material=colour_swatch_6)

pipe_6 = Pipe(Curve=[list_item_8, list_item_9], Radius=Slider(0.13, range=0..3), Caps=2)
custom_preview_23 = CustomPreview(Geometry=pipe_6, Material=colour_swatch_7)
custom_preview_24 = CustomPreview(Geometry=curve_curve_4.Points, Material=colour_swatch_7)
custom_curve_preview_8 = CustomCurvePreview(Curve=[extend_curve_7, extend_curve_8], Linetype=<geometry referenced from the Rhino model>, Colour=colour_swatch_7)

custom_preview_25 = CustomPreview(
    Geometry=ruled_surface_2,
    Material={diffuse=RGB(221, 160, 221), emission=RGB(66, 48, 66), shine=0.5, specular=RGB(255, 255, 255), transparency=0})
ruled_surface_3 = RuledSurface(CurveA=data)
custom_preview_26 = CustomPreview(
    Geometry=ruled_surface_3,
    Material={diffuse=RGB(221, 160, 221), emission=RGB(66, 48, 66), shine=0.5, specular=RGB(255, 255, 255), transparency=0})
number_slider_6 = Slider(0.4, range=0..5)
number_slider_7 = Slider(0.3, range=0..5)
shatter = Shatter()
negative_4 = Negative(Value=number_slider_7)
negative_5 = Negative(Value=number_slider_6)
construct_domain = ConstructDomain(DomainStart=negative_4, DomainEnd=number_slider_7)
construct_domain_2 = ConstructDomain(DomainStart=negative_5, DomainEnd=number_slider_6)
rectangle = Rectangle(Plane=curve_curve_6.Points, XSize=construct_domain, YSize=construct_domain_2, Radius=Slider(0.04, range=0..5))  # -> Rectangle, Length
surface_closest_point = SurfaceClosestPoint(Point=curve_curve_6.Points, Surface=reparameterize(bounded_shape_3))  # -> Point, UVPoint, Distance
surface_17 = Surface(rectangle.Rectangle)
evaluate_surface = EvaluateSurface(Surface=reparameterize(bounded_shape_3), Point=surface_closest_point.UVPoint)  # -> Point, Normal, UDirection, VDirection, Frame
area = Area(Geometry=surface_17)  # -> Area, Centroid
orient = Orient(Geometry=surface_17, Source=area.Centroid, Target=evaluate_surface.Frame)  # -> Geometry, Transform
curve_21 = Curve([<curve referenced from the Rhino model> x8])
# Boundary Curve
curve_22 = Curve(<curve referenced from the Rhino model>)
curve_23 = Curve([<curve referenced from the Rhino model> x5])
curve_24 = Curve([<curve referenced from the Rhino model> x10])
curve_25 = Curve([<curve referenced from the Rhino model> x7])
curve_26 = Curve([<curve referenced from the Rhino model> x2])
curve_27 = Curve([<curve referenced from the Rhino model> x2])
# Interior Shafts,
# Openings,
# Stair Boundary Curve
# 
# -Columnless areas
_4_01_main_building_area_boundary = EleFrontDataDescription(curve_22, ShiftDepth=0, isNameSet=True)
# ANNEXURE BUILDING LAYOUT
curve_28 = Curve(<curve referenced from the Rhino model>)
_4_05_02_internal_passages = EleFrontDataDescription(curve_21, ShiftDepth=0, isNameSet=True)
_4_05_01_internal_passages = EleFrontDataDescription(curve_27, ShiftDepth=0, isNameSet=True)
_4_04_internal_openings = EleFrontDataDescription(curve_26, ShiftDepth=0, isNameSet=True)
_4_03_internal_services = EleFrontDataDescription(curve_25, ShiftDepth=0, isNameSet=True)
_4_01_internal_stairs = EleFrontDataDescription(curve_23, ShiftDepth=0, isNameSet=True)
_4_02_internal_lifts = EleFrontDataDescription(curve_24, ShiftDepth=0, isNameSet=True)
custom_preview_27 = CustomPreview(Geometry=orient.Geometry, Material=colour_swatch_6)
curve_29 = Curve(flatten(Tree({0}: [<curve referenced from the Rhino model> x3], {1}: [<curve referenced from the Rhino model>])))
_5_01_annexure_area_boundary = EleFrontDataDescription(curve_28, ShiftDepth=0, isNameSet=True)
curve_30 = Curve([<curve referenced from the Rhino model> x5])
curve_31 = Curve([<curve referenced from the Rhino model> x8])
curve_32 = Curve([<curve referenced from the Rhino model> x3])
curve_33 = Curve(<curve referenced from the Rhino model>)
curve_34 = Curve()
_5_05_02_internal_passages = EleFrontDataDescription(curve_34, ShiftDepth=0, isNameSet=True)
_5_05_01_internal_passages = EleFrontDataDescription(curve_29, ShiftDepth=0, isNameSet=True)
_5_04_internal_openings = EleFrontDataDescription(curve_33, ShiftDepth=0, isNameSet=True)
_5_03_internal_services = EleFrontDataDescription(curve_32, ShiftDepth=0, isNameSet=True)
# MAIN BUILDING LAYOUT
data_5 = Data(_4_01_main_building_area_boundary)
data_6 = Data(_4_01_internal_stairs)
data_7 = Data(_4_02_internal_lifts)
data_8 = Data(_4_03_internal_services)
data_9 = Data(_4_04_internal_openings)
data_10 = Data(_4_05_01_internal_passages)
data_11 = Data(_4_05_02_internal_passages)
_5_01_internal_stairs = EleFrontDataDescription(curve_30, ShiftDepth=0, isNameSet=True)
_5_02_internal_lifts = EleFrontDataDescription(curve_31, ShiftDepth=0, isNameSet=True)
merge_3 = Merge(Data1=data_6, Data2=data_7, Data3=data_8, Data4=data_9, Data5=data_11)
data_12 = Data(_5_01_annexure_area_boundary)
data_13 = Data(_5_01_internal_stairs)
data_14 = Data(_5_02_internal_lifts)
data_15 = Data(_5_03_internal_services)
data_16 = Data(_5_04_internal_openings)
data_17 = Data(_5_05_01_internal_passages)
data_18 = Data()
surface_18 = Surface(data_5)
xy_plane = XYPlane(Origin=Point(0, 0, 0))
merge_4 = Merge(Data1=data_13, Data2=data_14, Data3=data_15, Data4=data_16)
surface_19 = Surface(data_12)
surface_20 = Surface(data_7)
loft = Loft(Curves=data_10, Options={Adjust=False, Closed=False, LoftEnds=0, LoftSimp=0, LoftType=0, Rebuild=10, Refit=0.01})
surface_split_4 = SurfaceSplit(Surface=surface_18, Curves=merge_3)
surface_21 = Surface(data_13)
surface_22 = Surface(data_9)
surface_23 = Surface(data_8)
custom_preview_28 = CustomPreview(Geometry=surface_20, Material=ColourSwatch(SwatchColor=RGB(100, 196, 196)))
surface_24 = Surface(data_11)
boundary_surfaces = BoundarySurfaces(Edges=_5_05_01_internal_passages)
surface_25 = Surface(_5_03_internal_services)
custom_preview_29 = CustomPreview(Geometry=surface_21, Material=ColourSwatch(SwatchColor=RGB(125, 27, 27)))
surface_26 = Surface(data_16)
surface_split_5 = SurfaceSplit(Surface=surface_19, Curves=merge_4)
custom_preview_30 = CustomPreview(Geometry=surface_23, Material=ColourSwatch(SwatchColor=RGB(92, 92, 92)))
custom_preview_31 = CustomPreview(Geometry=surface_22, Material=ColourSwatch(SwatchColor=RGB(255, 255, 255)))
custom_preview_32 = CustomPreview(Geometry=[loft, surface_24], Material=ColourSwatch(SwatchColor=RGB(133, 133, 133)))
curve_35 = Curve(data_12)
explode_6 = Explode(Curve=curve_35, Recursive=True)  # -> Segments, Vertices
custom_preview_33 = CustomPreview(Geometry=surface_25, Material=ColourSwatch(SwatchColor=RGB(92, 92, 92)))
custom_preview_34 = CustomPreview(Geometry=boundary_surfaces, Material=ColourSwatch(SwatchColor=RGBA(255, 255, 255, 161)))
custom_preview_35 = CustomPreview(Geometry=surface_26, Material=ColourSwatch(SwatchColor=RGB(219, 219, 219)))
surface_27 = Surface(data_6)
surface_28 = Surface(data_14)
# !!Find the Solved Splitted Surface
# each time when designs are changed
number_slider_8 = Slider(0, range=0..100)
custom_preview_36 = CustomPreview(Geometry=surface_27, Material=ColourSwatch(SwatchColor=RGB(42, 87, 87)))
custom_preview_37 = CustomPreview(Geometry=surface_28, Material=ColourSwatch(SwatchColor=RGB(191, 65, 65)))
bounding_box_4 = BoundingBox(Content=data_5, Plane=PlaneXY(0, 0, 0))  # -> Box, Box_2
list_item_16 = ListItem(List=explode_6.Segments, Index=0, Wrap=True)  # -> Item, Item1, Item2
list_item_17 = ListItem(List=explode_6.Segments, Index=0, Wrap=True)  # -> Item, Item1, Item2
# !!Find the Solved Splitted Surface
# each time when designs are changed
number_slider_9 = Slider(14, range=0..100)
list_item_18 = ListItem(List=surface_split_4, Index=number_slider_8, Wrap=True)
deconstruct_brep_4 = DeconstructBrep(Brep=bounding_box_4.Box)  # -> Faces, Edges, Vertices
list_item_19 = ListItem(List=surface_split_5, Index=number_slider_9, Wrap=True)
curve_36 = Curve(list_item_16.Item1)
curve_37 = Curve(list_item_17.Item2)
end_points_13 = EndPoints(Curve=curve_37)  # -> Start, End
curve_38 = Curve(deconstruct_brep_4.Edges)
surface_29 = Surface(list_item_18)
vector_2pt_5 = Vector2Pt(PointA=end_points_13.Start, PointB=end_points_13.End, Unitize=False)  # -> Vector, Length
surface_30 = Surface(list_item_19)
extrude = Extrude(Base=curve_36, Direction=vector_2pt_5.Vector)
data_19 = Data(curve_35)
deconstruct_brep_5 = DeconstructBrep(Brep=extrude)  # -> Faces, Edges, Vertices
bounded_shape_4 = EleFrontDataDescription(curve_38, ShiftDepth=0, isNameSet=True)
curve_39 = Curve(deconstruct_brep_5.Faces)
solved_shape_4 = EleFrontDataDescription(surface_29, ShiftDepth=0, isNameSet=True)
surface_31 = Surface(solved_shape_4)
custom_preview_38 = CustomPreview(Geometry=surface_31, Material=ColourSwatch(SwatchColor=RGB(21, 133, 133)))
data_20 = Data(curve_39)
solved_shape_5 = EleFrontDataDescription(surface_30, ShiftDepth=0, isNameSet=True)
surface_32 = Surface(solved_shape_5)
custom_preview_39 = CustomPreview(Geometry=surface_32, Material=ColourSwatch(SwatchColor=RGB(212, 114, 114)))
bounded_shape_5 = EleFrontDataDescription(curve_39, ShiftDepth=0, isNameSet=True)
join_curves_4 = JoinCurves(Curves=bounded_shape_4, Preserve=False)  # -> flatten(Curves)
bounded_shape_6 = EleFrontDataDescription(bounded_shape_5, ShiftDepth=0, isNameSet=True)
solved_shape_6 = EleFrontDataDescription(solved_shape_5, ShiftDepth=0, isNameSet=True)
bounded_shape_7 = EleFrontDataDescription(bounded_shape_5, ShiftDepth=0, isNameSet=False)
solved_shape_7 = EleFrontDataDescription(solved_shape_4, ShiftDepth=0, isNameSet=False)
solved_shape_8 = EleFrontDataDescription(solved_shape_4, ShiftDepth=0, isNameSet=False)
# GRID TYPE SOLVER 1-b
join_curves_5 = JoinCurves(Curves=bounded_shape_6, Preserve=False)  # -> flatten(Curves)
explode_7 = Explode(Curve=bounded_shape_7, Recursive=True)  # -> Segments, Vertices
# COPY ME FOR STRAIGHT LAYOUTS
data_21 = Data()
data_22 = Data()
data_23 = Data()
solved_shape_9 = EleFrontDataDescription(solved_shape_5, ShiftDepth=0, isNameSet=True)
solved_shape_10 = EleFrontDataDescription(solved_shape_6, ShiftDepth=0, isNameSet=True)
# Property Boundary Internal Even Offset X
number_slider_10 = Slider(3, range=0..10)
# Property Boundary Internal Even Offset Y
number_slider_11 = Slider(0, range=0..10)
merge_5 = Merge(Data1=data_22, Data2=data_23)
value_list = ValueList({"Even XY Start Offset": "0", "Specific X and Y Start Offset": "1"}, selected="Even XY Start Offset")
# GRID TYPE SOLVER 1_a
list_item_20 = ListItem(List=bounded_shape_4, Index=number_slider_10, Wrap=True)
list_item_21 = ListItem(List=bounded_shape_4, Index=number_slider_11, Wrap=True)
# GRID TYPE SOLVER 1_b
solved_shape_11 = EleFrontDataDescription(solved_shape_8, ShiftDepth=0, isNameSet=False)
surface_33 = Surface(data_21)
# GRID TYPE SOLVER 1_a
list_item_22 = ListItem(List=explode_7.Segments, Index=Slider(3, range=0..10), Wrap=True)
list_item_23 = ListItem(List=explode_7.Segments, Index=Slider(2, range=0..10), Wrap=True)
surface_split_6 = SurfaceSplit(Surface=surface_33, Curves=merge_5)
surface_34 = Surface(data_23)
custom_preview_40 = CustomPreview(Geometry=surface_34, Material=ColourSwatch(SwatchColor=RGB(42, 87, 87)))
surface_35 = Surface(data_22)
custom_preview_41 = CustomPreview(Geometry=surface_35, Material=ColourSwatch(SwatchColor=RGB(100, 196, 196)))
bounding_box_5 = BoundingBox(Content=data_21, Plane=PlaneXY(0, 0, 0))  # -> Box, Box_2
list_item_24 = ListItem(List=surface_split_6, Index=Slider(6, range=0..100), Wrap=True)
deconstruct_brep_6 = DeconstructBrep(Brep=bounding_box_5.Box)  # -> Faces, Edges, Vertices
curve_40 = Curve(deconstruct_brep_6.Edges)
surface_36 = Surface(list_item_24)
solved_shape_12 = EleFrontDataDescription(solved_shape_7, ShiftDepth=0, isNameSet=False)
unit_x_6 = UnitX(Factor=1)
unit_x_7 = UnitX(Factor=1)
solved_shape_13 = EleFrontDataDescription(solved_shape_9, ShiftDepth=0, isNameSet=True)
unit_y_7 = UnitY(Factor=1)
solved_shape_14 = EleFrontDataDescription(solved_shape_6, ShiftDepth=0, isNameSet=True)
unit_y_8 = UnitY(Factor=1)
bounded_shape_8 = EleFrontDataDescription(curve_40, ShiftDepth=0, isNameSet=True)
grid_extension_x_y_directions_4 = Slider(4, range=0..20)
solved_shape_15 = EleFrontDataDescription(surface_36, ShiftDepth=0, isNameSet=True)
surface_37 = Surface(solved_shape_15)
custom_preview_42 = CustomPreview(Geometry=surface_37, Material=ColourSwatch(SwatchColor=RGB(21, 133, 133)))
grid_extension_x_y_directions_5 = Slider(4, range=0..20)
grid_extension_x_y_directions_6 = Slider(4, range=0..20)

# ----
# GRID TYPE SOLVER 2
number_slider_12 = Slider(3, range=0..10)
explode_8 = Explode(Curve=bounded_shape_6, Recursive=True)  # -> Segments, Vertices
explode_9 = Explode(Curve=bounded_shape_6, Recursive=True)  # -> Segments, Vertices
list_item_25 = ListItem(List=explode_8.Segments, Index=number_slider_12, Wrap=True)
list_item_26 = ListItem(List=explode_9.Segments, Index=Slider(6, range=0..10), Wrap=True)
end_points_14 = EndPoints(Curve=list_item_25)  # -> Start, End
end_points_15 = EndPoints(Curve=list_item_26)  # -> Start, End
vector_2pt_6 = Vector2Pt(PointA=end_points_15.Start, PointB=end_points_15.End, Unitize=False)  # -> Vector, Length
grid_span_y_7 = Slider(6, range=0..20)
vector_2pt_7 = Vector2Pt(PointA=end_points_14.Start, PointB=end_points_14.End, Unitize=False)  # -> Vector, Length
grid_span_x_9 = Slider(4.5, range=0..20)
unit_vector_5 = UnitVector(Vector=vector_2pt_6.Vector)
unit_vector_6 = UnitVector(Vector=vector_2pt_7.Vector)
point_13 = Point(end_points_14.Start)
point_14 = Point(end_points_15.Start)
contour_13 = Contour(Shape=solved_shape_5, Point=point_14, Direction=unit_vector_5, Distance=grid_span_y_7)  # -> reparameterize(simplify(Contours))
contour_14 = Contour(Shape=solved_shape_5, Point=point_13, Direction=unit_vector_6, Distance=grid_span_x_9)  # -> reparameterize(simplify(Contours))
curve_curve_7 = CurveCurve(CurveA=flatten(contour_14), CurveB=graft(contour_13))  # -> Points, ParamsA, ParamsB
extend_curve_13 = ExtendCurve(Curve=contour_14, Type=0, Start=grid_extension_x_y_directions_6, End=grid_extension_x_y_directions_6)
extend_curve_14 = ExtendCurve(Curve=contour_13, Type=0, Start=grid_extension_x_y_directions_6, End=grid_extension_x_y_directions_6)
colour_swatch_8 = ColourSwatch(SwatchColor=RGB(255, 0, 0))
pipe_7 = Pipe(Curve=[list_item_25, list_item_26], Radius=Slider(0.13, range=0..3), Caps=2)
custom_preview_43 = CustomPreview(Geometry=pipe_7, Material=colour_swatch_8)
custom_preview_44 = CustomPreview(Geometry=curve_curve_7.Points, Material=colour_swatch_8)
custom_curve_preview_9 = CustomCurvePreview(Curve=[extend_curve_13, extend_curve_14], Linetype=<geometry referenced from the Rhino model>, Colour=colour_swatch_8)

# ----
# Extended Lines
grid_extension_x_y_directions_7 = Slider(4, range=0..20)

# ----
# GRID TYPE SOLVER 2
# No Initial Offsets to start
# chain of grids across X and Y
# Horizontal Axis Curve
# Vertical Axis Curve
number_slider_13 = Slider(0, range=0..10)
list_item_27 = ListItem(List=bounded_shape_4, Index=number_slider_13, Wrap=True)
list_item_28 = ListItem(List=bounded_shape_4, Index=Slider(3, range=0..10), Wrap=True)
end_points_16 = EndPoints(Curve=list_item_27)  # -> Start, End
end_points_17 = EndPoints(Curve=list_item_28)  # -> Start, End
grid_span_x_10 = Slider(4.5, range=0..20)
grid_span_y_8 = Slider(6, range=0..20)
unit_x_8 = UnitX(Factor=1)
unit_y_9 = UnitY(Factor=1)
point_15 = Point(end_points_16.Start)
point_16 = Point(end_points_17.Start)
contour_15 = Contour(Shape=solved_shape_4, Point=point_15, Direction=unit_x_8, Distance=grid_span_x_10)  # -> reparameterize(simplify(Contours))
contour_16 = Contour(Shape=solved_shape_4, Point=point_16, Direction=unit_y_9, Distance=grid_span_y_8)  # -> reparameterize(simplify(Contours))
curve_curve_8 = CurveCurve(CurveA=flatten(contour_15), CurveB=graft(contour_16))  # -> Points, ParamsA, ParamsB
extend_curve_15 = ExtendCurve(Curve=contour_15, Type=0, Start=grid_extension_x_y_directions_7, End=grid_extension_x_y_directions_7)
extend_curve_16 = ExtendCurve(Curve=contour_16, Type=0, Start=grid_extension_x_y_directions_7, End=grid_extension_x_y_directions_7)
colour_swatch_9 = ColourSwatch(SwatchColor=RGB(255, 0, 0))
ruled_surface_4 = RuledSurface(CurveA=data_5)
custom_preview_45 = CustomPreview(
    Geometry=ruled_surface_4,
    Material={diffuse=RGB(221, 160, 221), emission=RGB(66, 48, 66), shine=0.5, specular=RGB(255, 255, 255), transparency=0})

join_curves_6 = JoinCurves(Curves=bounded_shape_8, Preserve=False)  # -> flatten(Curves)
x_start_end_2 = Slider(0.3, range=0..5)
y_start_end_2 = Slider(0.4, range=0..5)
colour_swatch_10 = ColourSwatch(SwatchColor=RGB(0, 0, 0))
colour_swatch_11 = ColourSwatch(SwatchColor=RGB(0, 0, 0))
x_start_end_3 = Slider(0.3, range=0..5)
y_start_end_3 = Slider(0.4, range=0..5)
colour_swatch_12 = ColourSwatch(SwatchColor=RGB(0, 0, 0))

pipe_8 = Pipe(Curve=[list_item_27, list_item_28], Radius=Slider(0.13, range=0..3), Caps=2)
custom_preview_46 = CustomPreview(Geometry=pipe_8, Material=colour_swatch_9)
custom_preview_47 = CustomPreview(Geometry=curve_curve_8.Points, Material=colour_swatch_9)
custom_curve_preview_10 = CustomCurvePreview(Curve=[extend_curve_15, extend_curve_16], Linetype=<geometry referenced from the Rhino model>, Colour=colour_swatch_9)

colour_swatch_13 = ColourSwatch(SwatchColor=RGB(0, 0, 0))
# GRID TYPE SOLVER 2
number_slider_14 = Slider(0, range=0..10)
bounded_shape_9 = EleFrontDataDescription(bounded_shape_7, ShiftDepth=0, isNameSet=True)

boundary_internal_offset_4 = Slider(1.77, range=0..20)
grid_span_x_11 = Slider(3.36, range=0..20)
grid_span_y_9 = Slider(6.16, range=0..20)

negative_6 = Negative(Value=boundary_internal_offset_4)
panel_4 = Panel(boundary_internal_offset_4)
offset_curve_4 = OffsetCurve(Curve=join_curves_5, Distance=negative_6, Corners=1)
explode_10 = Explode(Curve=offset_curve_4, Recursive=True)  # -> Segments, Vertices
# Horizontal Axis Curve With a specific offset from the start point
list_item_29 = ListItem(List=explode_10.Segments, Index=Slider(2, range=0..10), Wrap=True)
list_item_30 = ListItem(List=explode_10.Segments, Index=Slider(3, range=0..10), Wrap=True)
end_points_18 = EndPoints(Curve=list_item_29)  # -> Start, End
end_points_19 = EndPoints(Curve=list_item_30)  # -> Start, End
vector_2pt_8 = Vector2Pt(PointA=end_points_18.Start, PointB=end_points_18.End, Unitize=False)  # -> Vector, Length
vector_2pt_9 = Vector2Pt(PointA=end_points_19.Start, PointB=end_points_19.End, Unitize=False)  # -> Vector, Length
unit_vector_7 = UnitVector(Vector=vector_2pt_8.Vector)
point_17 = Point(end_points_18.Start)
unit_vector_8 = UnitVector(Vector=vector_2pt_9.Vector)
point_18 = Point(end_points_19.End)
contour_17 = Contour(Shape=solved_shape_5, Point=point_18, Direction=unit_vector_7, Distance=grid_span_x_11)
contour_18 = Contour(Shape=solved_shape_5, Point=point_17, Direction=unit_vector_8, Distance=grid_span_y_9)
curve_curve_9 = CurveCurve(CurveA=flatten(contour_17), CurveB=graft(contour_18))  # -> Points, ParamsA, ParamsB
extend_curve_17 = ExtendCurve(Curve=contour_17, Type=0, Start=grid_extension_x_y_directions_6, End=grid_extension_x_y_directions_6)
extend_curve_18 = ExtendCurve(Curve=contour_18, Type=0, Start=grid_extension_x_y_directions_6, End=grid_extension_x_y_directions_6)

# ----
# Internal Offset Value X and Y
boundary_internal_offset_x = Slider(1.01, range=0..20)
boundary_internal_offset_y = Slider(0.45, range=0..20)
grid_span_x_12 = Slider(8.23, range=0..20)
grid_span_y_10 = Slider(5.43, range=0..20)

negative_7 = Negative(Value=boundary_internal_offset_x)
negative_8 = Negative(Value=boundary_internal_offset_y)
offset_curve_5 = OffsetCurve(Curve=list_item_21, Distance=negative_7, Corners=1)
offset_curve_6 = OffsetCurve(Curve=list_item_20, Distance=negative_8, Corners=1)
# Horizontal Axis Curve With a specific offset from the start point
data_24 = Data(offset_curve_6)
# Vertical Axis Curve With a specific offset from the start point
data_25 = Data(offset_curve_5)
end_points_20 = EndPoints(Curve=data_24)  # -> Start, End
end_points_21 = EndPoints(Curve=data_25)  # -> Start, End
point_19 = Point(end_points_20.Start)
point_20 = Point(end_points_21.End)
contour_19 = Contour(Shape=solved_shape_11, Point=point_19, Direction=unit_x_6, Distance=grid_span_x_12)
contour_20 = Contour(Shape=solved_shape_11, Point=point_20, Direction=unit_y_7, Distance=grid_span_y_10)
curve_curve_10 = CurveCurve(CurveA=flatten(contour_19), CurveB=graft(contour_20))  # -> Points, ParamsA, ParamsB
extend_curve_19 = ExtendCurve(Curve=contour_19, Type=0, Start=grid_extension_x_y_directions_5, End=grid_extension_x_y_directions_5)
extend_curve_20 = ExtendCurve(Curve=contour_20, Type=0, Start=grid_extension_x_y_directions_5, End=grid_extension_x_y_directions_5)
evenly_distributed_rectangle_from_origin_2 = EvenlyDistributedRectangleFromOrigin(
    x_start_2=curve_curve_10.Points,
    x_start=x_start_end_2,
    y_start_2=x_start_end_2,
    radius=Slider(0.04, range=0..5),
    y_start=y_start_end_2,
    y_end=y_start_end_2)
data_26 = Data(curve_curve_10.Points)
number_slider_15 = Slider(0.04, range=0..5)
x_start_end_4 = Slider(0.3, range=0..5)
y_start_end_4 = Slider(0.4, range=0..5)
list_item_31 = ListItem(List=bounded_shape_8, Index=number_slider_14, Wrap=True)

boundary_internal_offset_x_2 = Slider(0.44, range=0..20)
boundary_internal_offset_y_2 = Slider(0.31, range=0..20)
grid_span_x_13 = Slider(9.42, range=0..20)
grid_span_y_11 = Slider(5.06, range=0..20)

negative_9 = Negative(Value=boundary_internal_offset_x_2)
negative_10 = Negative(Value=boundary_internal_offset_y_2)
offset_curve_7 = OffsetCurve(Curve=list_item_23, Distance=negative_9, Corners=1)
offset_curve_8 = OffsetCurve(Curve=list_item_22, Distance=negative_10, Corners=1)
data_27 = Data(offset_curve_8)
data_28 = Data(offset_curve_7)
end_points_22 = EndPoints(Curve=data_27)  # -> Start, End
end_points_23 = EndPoints(Curve=data_28)  # -> Start, End
vector_2pt_10 = Vector2Pt(PointA=end_points_22.Start, PointB=end_points_22.End, Unitize=False)  # -> Vector, Length
vector_2pt_11 = Vector2Pt(PointA=end_points_23.Start, PointB=end_points_23.End, Unitize=False)  # -> Vector, Length
point_21 = Point(end_points_23.End)
point_22 = Point(end_points_22.Start)
contour_21 = Contour(Shape=solved_shape_14, Point=point_21, Direction=vector_2pt_10.Vector, Distance=grid_span_x_13)
contour_22 = Contour(Shape=solved_shape_13, Point=point_22, Direction=vector_2pt_11.Vector, Distance=grid_span_y_11)
curve_curve_11 = CurveCurve(CurveA=flatten(contour_21), CurveB=graft(contour_22))  # -> Points, ParamsA, ParamsB
extend_curve_21 = ExtendCurve(Curve=contour_21, Type=0, Start=grid_extension_x_y_directions_4, End=grid_extension_x_y_directions_4)
extend_curve_22 = ExtendCurve(Curve=contour_22, Type=0, Start=grid_extension_x_y_directions_4, End=grid_extension_x_y_directions_4)
list_item_32 = ListItem(List=bounded_shape_8, Index=Slider(3, range=0..10), Wrap=True)
surface_38 = Surface(evenly_distributed_rectangle_from_origin_2)

pipe_9 = Pipe(Curve=[data_24, data_25], Radius=Slider(0.19, range=0..3), Caps=2)
custom_preview_48 = CustomPreview(Material=colour_swatch_10)  # disabled
custom_preview_49 = CustomPreview(Geometry=pipe_9, Material=colour_swatch_10)
custom_curve_preview_11 = CustomCurvePreview(Curve=[extend_curve_19, extend_curve_20], Linetype=<geometry referenced from the Rhino model>, Colour=colour_swatch_10)
custom_preview_50 = CustomPreview(Geometry=surface_38, Material=colour_swatch_10)

# ----
# Internal Even Offset Value in both  XY
boundary_internal_offset_xy = Slider(2.8, range=0..20)
grid_span_x_14 = Slider(7.1, range=0..20)
grid_span_y_12 = Slider(8.93, range=0..20)

panel_5 = Panel(boundary_internal_offset_xy)
negative_11 = Negative(Value=panel_5)
# Property Boundary Internal Even Offset XY
offset_curve_9 = OffsetCurve(Curve=join_curves_4, Distance=negative_11, Corners=1)
explode_11 = Explode(Curve=offset_curve_9, Recursive=True)  # -> Segments, Vertices
data_29 = Data(explode_11.Segments)
pick_n_choose = PickNChoose(Pattern=value_list, Stream0=data_29)
# Horizontal Axis Curve With a specific offset from the start point
list_item_33 = ListItem(List=data_29, Index=Slider(1, range=0..10), Wrap=True)
# Vertical Axis Curve With a specific offset from the start point
list_item_34 = ListItem(List=data_29, Index=Slider(4, range=0..10), Wrap=True)
end_points_24 = EndPoints(Curve=list_item_33)  # -> Start, End
end_points_25 = EndPoints(Curve=list_item_34)  # -> Start, End
point_23 = Point(end_points_24.Start)
point_24 = Point(end_points_25.End)
contour_23 = Contour(Shape=solved_shape_12, Point=point_23, Direction=unit_x_7, Distance=grid_span_x_14)
contour_24 = Contour(Shape=solved_shape_12, Point=point_24, Direction=unit_y_8, Distance=grid_span_y_12)
curve_curve_12 = CurveCurve(CurveA=flatten(contour_23), CurveB=graft(contour_24))  # -> Points, ParamsA, ParamsB
extend_curve_23 = ExtendCurve(Curve=contour_23, Type=0, Start=grid_extension_x_y_directions_7, End=grid_extension_x_y_directions_7)
extend_curve_24 = ExtendCurve(Curve=contour_24, Type=0, Start=grid_extension_x_y_directions_7, End=grid_extension_x_y_directions_7)
evenly_distributed_rectangle_from_origin_3 = EvenlyDistributedRectangleFromOrigin(
    x_start_2=curve_curve_12.Points,
    x_start=x_start_end_3,
    y_start_2=x_start_end_3,
    radius=Slider(0.04, range=0..5),
    y_start=y_start_end_3,
    y_end=y_start_end_3)
surface_39 = Surface(evenly_distributed_rectangle_from_origin_3)

custom_preview_51 = CustomPreview(Geometry=curve_curve_12.Points, Material=colour_swatch_12)  # disabled
pipe_10 = Pipe(Curve=[list_item_33, list_item_34], Radius=Slider(0.19, range=0..3), Caps=2)
custom_preview_52 = CustomPreview(Geometry=pipe_10, Material=colour_swatch_12)
custom_preview_53 = CustomPreview(Geometry=surface_39, Material=colour_swatch_12)
# ( !!IMPORTANT NOTE!!- Please look into this each
#  time designs are been updated and toggle slider
# to find the correct solved surface )
custom_curve_preview_12 = CustomCurvePreview(Curve=[extend_curve_23, extend_curve_24], Linetype=<geometry referenced from the Rhino model>, Colour=colour_swatch_12)

end_points_26 = EndPoints(Curve=list_item_31)  # -> Start, End
end_points_27 = EndPoints(Curve=list_item_32)  # -> Start, End
grid_span_x_15 = Slider(4.5, range=0..20)
grid_span_y_13 = Slider(6, range=0..20)
bounded_shape_10 = EleFrontDataDescription(bounded_shape_6, ShiftDepth=0, isNameSet=True)
points = EleFrontDataDescription(curve_curve_9.Points, ShiftDepth=0, isNameSet=True)
evenly_distributed_rectangle_from_origin_4 = EvenlyDistributedRectangleFromOrigin(
    x_start_2=curve_curve_9.Points,
    x_start=x_start_end_4,
    y_start_2=x_start_end_4,
    radius=Slider(0.04, range=0..5),
    y_start=y_start_end_4,
    y_end=y_start_end_4)
x_start_end_5 = Slider(0.4, range=0..5)
y_start_end_5 = Slider(0.3, range=0..5)
unit_x_9 = UnitX(Factor=1)
unit_y_10 = UnitY(Factor=1)
unit_x_10 = UnitX(Factor=1)
surface_closest_point_2 = SurfaceClosestPoint(Point=points, Surface=reparameterize(bounded_shape_10))  # -> Point, UVPoint, Distance
point_25 = Point(end_points_26.Start)
surface_40 = Surface(evenly_distributed_rectangle_from_origin_4)
point_26 = Point(end_points_27.Start)
unit_y_11 = UnitY(Factor=1)
contour_25 = Contour(Shape=solved_shape_15, Point=point_25, Direction=unit_x_9, Distance=grid_span_x_15)  # -> reparameterize(simplify(Contours))
points_2 = EleFrontDataDescription(curve_curve_11.Points, ShiftDepth=0, isNameSet=True)
bounded_shape_11 = EleFrontDataDescription(bounded_shape_9, ShiftDepth=0, isNameSet=True)
contour_26 = Contour(Shape=solved_shape_15, Point=point_26, Direction=unit_y_10, Distance=grid_span_y_13)  # -> reparameterize(simplify(Contours))
points_3 = EleFrontDataDescription(curve_curve_11.Points, ShiftDepth=0, isNameSet=True)
evenly_distributed_rectangle_from_origin_5 = EvenlyDistributedRectangleFromOrigin(
    x_start_2=points_2,
    x_start=x_start_end_5,
    y_start_2=x_start_end_5,
    radius=Slider(0.04, range=0..5),
    y_start=y_start_end_5,
    y_end=y_start_end_5)
evaluate_surface_2 = EvaluateSurface(Surface=reparameterize(bounded_shape_10), Point=surface_closest_point_2.UVPoint)  # -> Point, Normal, UDirection, VDirection, Frame
grid_span_x_16 = Slider(5, range=0..20)
grid_span_y_14 = Slider(5, range=0..20)
grid_extension_x_y_directions_8 = Slider(4, range=0..20)
surface_closest_point_3 = SurfaceClosestPoint(Point=points_3, Surface=reparameterize(bounded_shape_11))  # -> Point, UVPoint, Distance
surface_41 = Surface(evenly_distributed_rectangle_from_origin_5)
area_2 = Area(Geometry=surface_40)  # -> Area, Centroid
orient_2 = Orient(Geometry=surface_40, Source=area_2.Centroid, Target=evaluate_surface_2.Frame)  # -> Geometry, Transform

pipe_11 = Pipe(Curve=[list_item_29, list_item_30], Radius=Slider(0.19, range=0..3), Caps=2)
custom_preview_54 = CustomPreview(Material=colour_swatch_11)
custom_preview_55 = CustomPreview(Geometry=pipe_11, Material=colour_swatch_11)
custom_preview_56 = CustomPreview(Geometry=orient_2.Geometry, Material=colour_swatch_11)
custom_curve_preview_13 = CustomCurvePreview(Curve=[extend_curve_17, extend_curve_18], Linetype=<geometry referenced from the Rhino model>, Colour=colour_swatch_11)

curve_curve_13 = CurveCurve(CurveA=flatten(contour_25), CurveB=graft(contour_26))  # -> Points, ParamsA, ParamsB
evaluate_surface_3 = EvaluateSurface(Surface=reparameterize(bounded_shape_11), Point=surface_closest_point_3.UVPoint)  # -> Point, Normal, UDirection, VDirection, Frame
area_3 = Area(Geometry=surface_41)  # -> Area, Centroid
extend_curve_25 = ExtendCurve(Curve=contour_25, Type=0, Start=grid_extension_x_y_directions_8, End=grid_extension_x_y_directions_8)
extend_curve_26 = ExtendCurve(Curve=contour_26, Type=0, Start=grid_extension_x_y_directions_8, End=grid_extension_x_y_directions_8)
colour_swatch_14 = ColourSwatch(SwatchColor=RGB(0, 0, 0))
colour_swatch_15 = ColourSwatch(SwatchColor=RGB(255, 0, 0))
orient_3 = Orient(Geometry=surface_41, Source=area_3.Centroid, Target=evaluate_surface_3.Frame)  # -> Geometry, Transform

pipe_12 = Pipe(Curve=[data_27, data_28], Radius=Slider(0.19, range=0..3), Caps=2)
custom_preview_57 = CustomPreview(Geometry=pipe_12, Material=colour_swatch_13)
custom_preview_58 = CustomPreview(Geometry=orient_3.Geometry, Material=colour_swatch_13)
custom_curve_preview_14 = CustomCurvePreview(Curve=[extend_curve_21, extend_curve_22], Linetype=<geometry referenced from the Rhino model>, Colour=colour_swatch_13)

boundary_internal_offset_5 = Slider(2.85, range=0..20)
negative_12 = Negative(Value=boundary_internal_offset_5)
panel_6 = Panel(boundary_internal_offset_5)
offset_curve_10 = OffsetCurve(Curve=join_curves_6, Distance=negative_12, Corners=1)
# GRID TYPE SOLVER 1
explode_12 = Explode(Curve=offset_curve_10, Recursive=True)  # -> Segments, Vertices
list_item_35 = ListItem(List=explode_12.Segments, Index=Slider(1, range=0..10), Wrap=True)
list_item_36 = ListItem(List=explode_12.Segments, Index=Slider(4, range=0..10), Wrap=True)
end_points_28 = EndPoints(Curve=list_item_35)  # -> Start, End
end_points_29 = EndPoints(Curve=list_item_36)  # -> Start, End
point_27 = Point(end_points_28.Start)
point_28 = Point(end_points_29.End)
contour_27 = Contour(Shape=solved_shape_15, Point=point_27, Direction=unit_x_10, Distance=grid_span_x_16)
contour_28 = Contour(Shape=solved_shape_15, Point=point_28, Direction=unit_y_11, Distance=grid_span_y_14)
curve_curve_14 = CurveCurve(CurveA=flatten(contour_27), CurveB=graft(contour_28))  # -> Points, ParamsA, ParamsB
extend_curve_27 = ExtendCurve(Curve=contour_27, Type=0, Start=grid_extension_x_y_directions_8, End=grid_extension_x_y_directions_8)
extend_curve_28 = ExtendCurve(Curve=contour_28, Type=0, Start=grid_extension_x_y_directions_8, End=grid_extension_x_y_directions_8)
ruled_surface_5 = RuledSurface(CurveA=data_21)
pipe_13 = Pipe(Curve=[list_item_31, list_item_32], Radius=Slider(0.13, range=0..3), Caps=2)
custom_preview_59 = CustomPreview(Geometry=pipe_13, Material=colour_swatch_15)
custom_preview_60 = CustomPreview(Geometry=curve_curve_13.Points, Material=colour_swatch_15)
custom_curve_preview_15 = CustomCurvePreview(Curve=[extend_curve_25, extend_curve_26], Linetype=<geometry referenced from the Rhino model>, Colour=colour_swatch_15)
custom_preview_61 = CustomPreview(
    Geometry=ruled_surface_5,
    Material={diffuse=RGB(221, 160, 221), emission=RGB(66, 48, 66), shine=0.5, specular=RGB(255, 255, 255), transparency=0})
pipe_14 = Pipe(Curve=[list_item_35, list_item_36], Radius=Slider(0.19, range=0..3), Caps=2)
custom_preview_62 = CustomPreview(Geometry=curve_curve_14.Points, Material=colour_swatch_14)
custom_preview_63 = CustomPreview(Geometry=pipe_14, Material=colour_swatch_14)
custom_curve_preview_16 = CustomCurvePreview(Curve=[extend_curve_27, extend_curve_28], Linetype=<geometry referenced from the Rhino model>, Colour=colour_swatch_14)

# ==== cluster EvenlyDistributedRectangleFromOrigin
x_start = ClusterInput()
y_start = ClusterInput()
y_start_2 = ClusterInput()
negative = Negative(Value=x_start)
negative_2 = Negative(Value=y_start)
y_end = ClusterInput()
x_start_2 = ClusterInput()
construct_domain = ConstructDomain(DomainStart=negative, DomainEnd=y_start_2)
construct_domain_2 = ConstructDomain(DomainStart=negative_2, DomainEnd=y_end)
radius = ClusterInput()
rectangle = Rectangle(Plane=x_start_2, XSize=construct_domain, YSize=construct_domain_2, Radius=radius)  # -> Rectangle, Length
rectangle_2 = ClusterOutput(rectangle.Rectangle)
