# Grasshopper definition GRID_DERIVATION_FROM_BUILTAREA_V1.gh (Grasshopper 1.0.8)
# plug-ins: Bifocals, eleFront

curve = Curve(flatten(<curve referenced from the Rhino model>))
curve_2 = Curve(flatten([<curve referenced from the Rhino model> x4]))
# TILTED LAYOUT
# Boundary Curve
# Interior Shafts,
# Openings,
# Stair Boundary Curve
# 
# -Columnless areas
curve_3 = Curve(<curve referenced from the Rhino model>)
curve_4 = Curve([<curve referenced from the Rhino model> x8])
curve_5 = Curve([<curve referenced from the Rhino model> x3])

# ---- group: CURVE 3 SHAPED CURVE
# Boundary Curve
curve_6 = Curve(<curve referenced from the Rhino model>)

# ----
# Boundary Curve
curve_7 = Curve(<curve referenced from the Rhino model>)
curve_8 = Curve([<curve referenced from the Rhino model> x7])
# Interior Shafts,
# Openings,
# Stair Boundary Curve
# 
# -Columnless areas
curve_9 = Curve([<curve referenced from the Rhino model> x3])
_3_02_tilted_built_area_boundary = EleFrontDataDescription(curve_3, ShiftDepth=0, isNameSet=True)
_3_02_internal_boundary_curves = EleFrontDataDescription(curve_4, ShiftDepth=0, isNameSet=True)
_3_03_internal_boundary_curves = EleFrontDataDescription(curve_5, ShiftDepth=0, isNameSet=True)

# ---- group: CURVE CIRCULATIONS
# Interior Shafts,
# Openings,
# Stair Boundary Curve
# 
# -Columnless areas
curve_10 = Curve([<curve referenced from the Rhino model> x2])

# ---- group: CURVE 3 SHAFT LISTS
curve_11 = Curve([<curve referenced from the Rhino model> x12])

# ----
_3_01_chopped_built_area_boundary = EleFrontDataDescription(curve_7, ShiftDepth=0, isNameSet=True)

# ---- group: CURVE 2 30X40 M
# Curve Collection
curve_12 = Curve(<curve referenced from the Rhino model>)

# ----
_3_01_internal_boundary_curves = EleFrontDataDescription(curve_8, ShiftDepth=0, isNameSet=True)
_3_02_internal_boundary_curves_2 = EleFrontDataDescription(curve_9, ShiftDepth=0, isNameSet=True)

# ---- group: CURVE 2 SHAFTS LIFTS
curve_13 = Curve([<curve referenced from the Rhino model> x7])

# ----
# LINEAR LAYOUT
curve_14 = Curve(<curve referenced from the Rhino model>)
surface = Surface(curve_6)
data = Data(_3_02_tilted_built_area_boundary)
# COPY ME FOR STRAIGHT LAYOUTS
# Boundary Curve
# Interior Shafts,
# Openings,
# Stair Boundary Curve
# 
# -Columnless areas
data_2 = Data()
data_3 = Data()
data_4 = Data()
data_5 = Data(_3_02_internal_boundary_curves)
data_6 = Data(_3_03_internal_boundary_curves)
merge = Merge(Data1=data_3, Data2=data_4)
merge_2 = Merge(Data1=data_5, Data2=data_6)
surface_split = SurfaceSplit(Surface=surface, Curves=[curve_11, curve_10])
merge_3 = Merge(Data1=_3_01_internal_boundary_curves, Data2=_3_02_internal_boundary_curves_2)
surface_2 = Surface(curve_10)
surface_3 = Surface(data)
custom_preview = CustomPreview(Geometry=surface_2, Material=ColourSwatch(SwatchColor=RGB(42, 87, 87)))
surface_4 = Surface(_3_01_chopped_built_area_boundary)
surface_5 = Surface(data_2)
surface_split_2 = SurfaceSplit(Surface=surface_3, Curves=merge_2)
surface_6 = Surface(curve_11)
surface_7 = Surface(data_6)
# Find the Solved Splitted Surface
# each time when designs are changed
# ( !!IMPORTANT NOTE!!- Please look into this each
#  time designs are been updated and toggle slider
# to find the correct solved surface )
number_slider = Slider(10, range=0..100)
surface_split_3 = SurfaceSplit(Surface=surface_4, Curves=merge_3)
custom_preview_2 = CustomPreview(Geometry=surface_7, Material=ColourSwatch(SwatchColor=RGB(42, 87, 87)))
custom_preview_3 = CustomPreview(Geometry=surface_6, Material=ColourSwatch(SwatchColor=RGB(100, 196, 196)))
surface_8 = Surface(_3_02_internal_boundary_curves_2)
surface_split_4 = SurfaceSplit(Surface=surface_5, Curves=merge)
bounding_box = BoundingBox(Content=curve_6, Plane=PlaneXY(0, 0, 0))  # -> Box, Box_2
surface_9 = Surface(data_4)
custom_preview_4 = CustomPreview(Geometry=surface_8, Material=ColourSwatch(SwatchColor=RGB(42, 87, 87)))
list_item = ListItem(List=surface_split, Index=number_slider, Wrap=True)
custom_preview_5 = CustomPreview(Geometry=surface_9, Material=ColourSwatch(SwatchColor=RGB(42, 87, 87)))
surface_10 = Surface(data_5)
deconstruct_brep = DeconstructBrep(Brep=bounding_box.Box)  # -> Faces, Edges, Vertices
# Find the Solved Splitted Surface
# each time when designs are changed
# ( !!IMPORTANT NOTE!!- Please look into this each
#  time designs are been updated and toggle slider
# to find the correct solved surface )
number_slider_2 = Slider(11, range=0..100)
custom_preview_6 = CustomPreview(Geometry=surface_10, Material=ColourSwatch(SwatchColor=RGB(100, 196, 196)))
surface_11 = Surface(_3_01_internal_boundary_curves)
bounding_box_2 = BoundingBox(Content=data, Plane=PlaneXY(0, 0, 0))  # -> Box, Box_2
# Find the Solved Splitted Surface
# each time when designs are changed
# ( !!IMPORTANT NOTE!!- Please look into this each
#  time designs are been updated and toggle slider
# to find the correct solved surface )
number_slider_3 = Slider(7, range=0..100)
surface_12 = Surface(data_3)
custom_preview_7 = CustomPreview(Geometry=surface_11, Material=ColourSwatch(SwatchColor=RGB(100, 196, 196)))
list_item_2 = ListItem(List=surface_split_2, Index=number_slider_2, Wrap=True)
# Find the Solved Splitted Surface
# each time when designs are changed
# ( !!IMPORTANT NOTE!!- Please look into this each
#  time designs are been updated and toggle slider
# to find the correct solved surface )
number_slider_4 = Slider(6, range=0..100)
bounding_box_3 = BoundingBox(Content=_3_01_chopped_built_area_boundary, Plane=PlaneXY(0, 0, 0))  # -> Box, Box_2
custom_preview_8 = CustomPreview(Geometry=surface_12, Material=ColourSwatch(SwatchColor=RGB(100, 196, 196)))
list_item_3 = ListItem(List=surface_split_3, Index=number_slider_3, Wrap=True)
bounding_box_4 = BoundingBox(Content=data_2, Plane=PlaneXY(0, 0, 0))  # -> Box, Box_2
curve_15 = Curve(deconstruct_brep.Edges)
surface_13 = Surface(list_item)
deconstruct_brep_2 = DeconstructBrep(Brep=bounding_box_2.Box)  # -> Faces, Edges, Vertices
list_item_4 = ListItem(List=surface_split_4, Index=number_slider_4, Wrap=True)
deconstruct_brep_3 = DeconstructBrep(Brep=bounding_box_3.Box)  # -> Faces, Edges, Vertices
deconstruct_brep_4 = DeconstructBrep(Brep=bounding_box_4.Box)  # -> Faces, Edges, Vertices
curve_16 = Curve(deconstruct_brep_2.Edges)
curve_17 = Curve(data)
surface_14 = Surface(list_item_2)
curve_18 = Curve(deconstruct_brep_3.Edges)
surface_15 = Surface(list_item_3)
curve_19 = Curve(deconstruct_brep_4.Edges)
surface_16 = Surface(list_item_4)
data_7 = Data(curve_17)
bounded_shape = EleFrontDataDescription(curve_15, ShiftDepth=0, isNameSet=True)
solved_shape = EleFrontDataDescription(surface_13, ShiftDepth=0, isNameSet=True)
surface_17 = Surface(solved_shape)
custom_preview_9 = CustomPreview(Geometry=surface_17, Material=ColourSwatch(SwatchColor=RGB(21, 133, 133)))
bounded_shape_2 = EleFrontDataDescription(data_7, ShiftDepth=0, isNameSet=True)
solved_shape_2 = EleFrontDataDescription(surface_14, ShiftDepth=0, isNameSet=True)
surface_18 = Surface(solved_shape_2)
custom_preview_10 = CustomPreview(Geometry=surface_18, Material=ColourSwatch(SwatchColor=RGB(21, 133, 133)))
bounded_shape_3 = EleFrontDataDescription(curve_18, ShiftDepth=0, isNameSet=True)
solved_shape_3 = EleFrontDataDescription(surface_15, ShiftDepth=0, isNameSet=True)
surface_19 = Surface(solved_shape_3)
custom_preview_11 = CustomPreview(Geometry=surface_19, Material=ColourSwatch(SwatchColor=RGB(21, 133, 133)))
bounded_shape_4 = EleFrontDataDescription(curve_19, ShiftDepth=0, isNameSet=True)
solved_shape_4 = EleFrontDataDescription(surface_16, ShiftDepth=0, isNameSet=True)
surface_20 = Surface(solved_shape_4)
custom_preview_12 = CustomPreview(Geometry=surface_20, Material=ColourSwatch(SwatchColor=RGB(21, 133, 133)))
# Property Boundary Internal Even Offset
join_curves = JoinCurves(Curves=bounded_shape_2, Preserve=False)  # -> flatten(Curves)
# Property Boundary Internal Even Offset
join_curves_2 = JoinCurves(Curves=bounded_shape_3, Preserve=False)  # -> flatten(Curves)
# Property Boundary Internal Even Offset
join_curves_3 = JoinCurves(Curves=bounded_shape_4, Preserve=False)  # -> flatten(Curves)
# GRID TYPE SOLVER 2
explode = Explode(Curve=bounded_shape_2, Recursive=True)  # -> Segments, Vertices
explode_2 = Explode(Curve=bounded_shape_2, Recursive=True)  # -> Segments, Vertices
# GRID TYPE SOLVER 2
number_slider_5 = Slider(0, range=0..10)
# GRID TYPE SOLVER 2
number_slider_6 = Slider(0, range=0..10)
# Horizontal Axis Curve
list_item_5 = ListItem(List=explode.Segments, Index=Slider(3, range=0..10), Wrap=True)
grid_span_x = Slider(4.5, range=0..20)

# ----
# GRID TYPE SOLVER 2
number_slider_7 = Slider(0, range=0..10)
# No Initial Offsets to start
# chain of grids across X and Y
# Horizontal Axis Curve
list_item_6 = ListItem(List=bounded_shape, Index=number_slider_7, Wrap=True)
end_points = EndPoints(Curve=list_item_6)  # -> Start, End
unit_x = UnitX(Factor=1)
point = Point(end_points.Start)
contour = Contour(Shape=solved_shape, Point=point, Direction=unit_x, Distance=grid_span_x)  # -> reparameterize(simplify(Contours))

# ----
# GRID TYPE SOLVER 3
# Horizontal Axis Curve /  A Fixed distance
curve_20 = Curve(list_item_6)

grid_span_x_2 = Slider(6, range=0..20)
length = Length(Curve=curve_20)
division = Division(A=length, B=grid_span_x_2)
# Standard Even Interval Offsets across X and Y
divide_curve = DivideCurve(Curve=curve_20, Count=division, Kinks=False)  # -> Points, Tangents, Parameters

grid_span_y = Slider(6, range=0..20)

# ----
# Vertical Axis Curve
list_item_7 = ListItem(List=bounded_shape, Index=Slider(3, range=0..10), Wrap=True)
end_points_2 = EndPoints(Curve=list_item_7)  # -> Start, End
unit_y = UnitY(Factor=1)
point_2 = Point(end_points_2.Start)
contour_2 = Contour(Shape=solved_shape, Point=point_2, Direction=unit_y, Distance=grid_span_y)  # -> reparameterize(simplify(Contours))

# ----
# Vertical Axis Curve /  A Fixed distance
curve_21 = Curve(list_item_7)

grid_span_x_3 = Slider(6, range=0..20)
length_2 = Length(Curve=curve_20)
division_2 = Division(A=length_2, B=grid_span_x_3)
divide_curve_2 = DivideCurve(Curve=curve_21, Count=division_2, Kinks=False)  # -> Points, Tangents, Parameters

# ----
# Vertical Axis Curve
list_item_8 = ListItem(List=explode_2.Segments, Index=Slider(6, range=0..10), Wrap=True)
unit_y_2 = UnitY(Factor=1)
# No Initial Offsets to start
# chain of grids across X and Y
# Horizontal Axis Curve
list_item_9 = ListItem(List=bounded_shape_3, Index=number_slider_5, Wrap=True)
unit_x_2 = UnitX(Factor=1)
# Vertical Axis Curve
list_item_10 = ListItem(List=bounded_shape_3, Index=Slider(3, range=0..10), Wrap=True)
# No Initial Offsets to start
# chain of grids across X and Y
# Horizontal Axis Curve
list_item_11 = ListItem(List=bounded_shape_4, Index=number_slider_6, Wrap=True)
# No Initial Offsets to start
# chain of grids across X and Y
end_points_3 = EndPoints(Curve=list_item_5)  # -> Start, End
# Vertical Axis Curve
list_item_12 = ListItem(List=bounded_shape_4, Index=Slider(3, range=0..10), Wrap=True)
end_points_4 = EndPoints(Curve=list_item_8)  # -> Start, End
vector_2pt = Vector2Pt(PointA=end_points_4.Start, PointB=end_points_4.End, Unitize=False)  # -> Vector, Length
end_points_5 = EndPoints(Curve=list_item_9)  # -> Start, End
grid_span_y_2 = Slider(6, range=0..20)
end_points_6 = EndPoints(Curve=list_item_10)  # -> Start, End
vector_2pt_2 = Vector2Pt(PointA=end_points_3.Start, PointB=end_points_3.End, Unitize=False)  # -> Vector, Length
end_points_7 = EndPoints(Curve=list_item_11)  # -> Start, End
grid_span_x_4 = Slider(4.5, range=0..20)
grid_span_x_5 = Slider(4.5, range=0..20)
grid_span_y_3 = Slider(6, range=0..20)
line_sdl = LineSDL(Start=divide_curve.Points, Direction=unit_y_2, Length=length_2)
line_sdl_2 = LineSDL(Start=divide_curve_2.Points, Direction=unit_x_2, Length=length)
end_points_8 = EndPoints(Curve=list_item_12)  # -> Start, End
unit_vector = UnitVector(Vector=vector_2pt.Vector)
grid_span_x_6 = Slider(4.5, range=0..20)
grid_span_y_4 = Slider(6, range=0..20)
unit_x_3 = UnitX(Factor=1)
unit_y_3 = UnitY(Factor=1)
unit_vector_2 = UnitVector(Vector=vector_2pt_2.Vector)
unit_x_4 = UnitX(Factor=1)
unit_x_5 = UnitX(Factor=1)
point_3 = Point(end_points_3.Start)
unit_y_4 = UnitY(Factor=1)
point_4 = Point(end_points_4.Start)
unit_x_6 = UnitX(Factor=1)
unit_y_5 = UnitY(Factor=1)
point_5 = Point(end_points_5.Start)
grid_span_x_7 = Slider(5, range=0..20)
grid_span_y_5 = Slider(5, range=0..20)
grid_extension_x_y_directions = Slider(4, range=0..20)
point_6 = Point(end_points_6.Start)
unit_y_6 = UnitY(Factor=1)
contour_3 = Contour(Shape=solved_shape_2, Point=point_4, Direction=unit_vector, Distance=grid_span_y_2)  # -> reparameterize(simplify(Contours))
point_7 = Point(end_points_7.Start)
contour_4 = Contour(Shape=solved_shape_3, Point=point_5, Direction=unit_x_3, Distance=grid_span_x_5)  # -> reparameterize(simplify(Contours))
point_8 = Point(end_points_8.Start)
contour_5 = Contour(Shape=solved_shape_2, Point=point_3, Direction=unit_vector_2, Distance=grid_span_x_4)  # -> reparameterize(simplify(Contours))
unit_y_7 = UnitY(Factor=1)
contour_6 = Contour(Shape=solved_shape_3, Point=point_6, Direction=unit_y_3, Distance=grid_span_y_3)  # -> reparameterize(simplify(Contours))
contour_7 = Contour(Shape=solved_shape_4, Point=point_7, Direction=unit_x_4, Distance=grid_span_x_6)  # -> reparameterize(simplify(Contours))
contour_8 = Contour(Shape=solved_shape_4, Point=point_8, Direction=unit_y_4, Distance=grid_span_y_4)  # -> reparameterize(simplify(Contours))
grid_span_x_8 = Slider(5, range=0..20)
grid_span_y_6 = Slider(5, range=0..20)
grid_extension_x_y_directions_2 = Slider(4, range=0..20)
curve_curve = CurveCurve(CurveA=flatten(contour), CurveB=graft(contour_2))  # -> Points, ParamsA, ParamsB
grid_span_x_9 = Slider(8, range=0..20)
grid_span_y_7 = Slider(5, range=0..20)
grid_extension_x_y_directions_3 = Slider(4, range=0..20)
grid_span_x_10 = Slider(5, range=0..20)
grid_span_y_8 = Slider(5, range=0..20)
grid_extension_x_y_directions_4 = Slider(4, range=0..20)
curve_curve_2 = CurveCurve(CurveA=flatten(contour_5), CurveB=graft(contour_3))  # -> Points, ParamsA, ParamsB

# ----
# Extended Lines
extend_curve = ExtendCurve(Curve=contour, Type=0, Start=grid_extension_x_y_directions, End=grid_extension_x_y_directions)
extend_curve_2 = ExtendCurve(Curve=contour_2, Type=0, Start=grid_extension_x_y_directions, End=grid_extension_x_y_directions)

colour_swatch = ColourSwatch(SwatchColor=RGB(0, 0, 0))
curve_curve_3 = CurveCurve(CurveA=flatten(contour_4), CurveB=graft(contour_6))  # -> Points, ParamsA, ParamsB
colour_swatch_2 = ColourSwatch(SwatchColor=RGB(255, 0, 0))
curve_curve_4 = CurveCurve(CurveA=flatten(contour_7), CurveB=graft(contour_8))  # -> Points, ParamsA, ParamsB
# Internal Offset Value
boundary_internal_offset = Slider(2.85, range=0..20)

# ----
# Property Boundary Internal Even Offset
join_curves_4 = JoinCurves(Curves=bounded_shape, Preserve=False)  # -> flatten(Curves)
negative = Negative(Value=boundary_internal_offset)
offset_curve = OffsetCurve(Curve=join_curves_4, Distance=negative, Corners=1)
# GRID TYPE SOLVER 1
explode_3 = Explode(Curve=offset_curve, Recursive=True)  # -> Segments, Vertices

panel = Panel(boundary_internal_offset)

# ----
# Horizontal Axis Curve With a specific offset from the start point
list_item_13 = ListItem(List=explode_3.Segments, Index=Slider(1, range=0..10), Wrap=True)
# Specific Initial Offsets to start
# chain of grids across X and Y
end_points_9 = EndPoints(Curve=list_item_13)  # -> Start, End
unit_x_7 = UnitX(Factor=1)
point_9 = Point(end_points_9.Start)
contour_9 = Contour(Shape=solved_shape, Point=point_9, Direction=unit_x_7, Distance=grid_span_x_7)

# ----
# Vertical Axis Curve With a specific offset from the start point
list_item_14 = ListItem(List=explode_3.Segments, Index=Slider(4, range=0..10), Wrap=True)
end_points_10 = EndPoints(Curve=list_item_14)  # -> Start, End
unit_y_8 = UnitY(Factor=1)
point_10 = Point(end_points_10.End)
contour_10 = Contour(Shape=solved_shape, Point=point_10, Direction=unit_y_8, Distance=grid_span_y_5)

curve_curve_5 = CurveCurve(CurveA=flatten(contour_9), CurveB=graft(contour_10))  # -> Points, ParamsA, ParamsB

# ----
# Extended Lines
extend_curve_3 = ExtendCurve(Curve=contour_9, Type=0, Start=grid_extension_x_y_directions, End=grid_extension_x_y_directions)
extend_curve_4 = ExtendCurve(Curve=contour_10, Type=0, Start=grid_extension_x_y_directions, End=grid_extension_x_y_directions)

colour_swatch_3 = ColourSwatch(SwatchColor=RGB(0, 150, 150))
extend_curve_5 = ExtendCurve(Curve=contour_5, Type=0, Start=grid_extension_x_y_directions_2, End=grid_extension_x_y_directions_2)
extend_curve_6 = ExtendCurve(Curve=contour_3, Type=0, Start=grid_extension_x_y_directions_2, End=grid_extension_x_y_directions_2)
colour_swatch_4 = ColourSwatch(SwatchColor=RGB(0, 0, 0))

pipe = Pipe(Curve=[list_item_13, list_item_14], Radius=Slider(0.19, range=0..3), Caps=2)
custom_preview_13 = CustomPreview(Geometry=curve_curve_5.Points, Material=colour_swatch)
custom_preview_14 = CustomPreview(Geometry=pipe, Material=colour_swatch)
custom_curve_preview = CustomCurvePreview(Curve=[extend_curve_3, extend_curve_4], Linetype=<geometry referenced from the Rhino model>, Colour=colour_swatch)

pipe_2 = Pipe(Curve=[list_item_6, list_item_7], Radius=Slider(0.13, range=0..3), Caps=2)
custom_preview_15 = CustomPreview(Geometry=pipe_2, Material=colour_swatch_2)
custom_preview_16 = CustomPreview(Geometry=curve_curve.Points, Material=colour_swatch_2)
custom_curve_preview_2 = CustomCurvePreview(Curve=[extend_curve, extend_curve_2], Linetype=<geometry referenced from the Rhino model>, Colour=colour_swatch_2)

# ----
# Extended Lines
extend_curve_7 = ExtendCurve(Curve=contour_4, Type=0, Start=grid_extension_x_y_directions_3, End=grid_extension_x_y_directions_3)
extend_curve_8 = ExtendCurve(Curve=contour_6, Type=0, Start=grid_extension_x_y_directions_3, End=grid_extension_x_y_directions_3)
colour_swatch_5 = ColourSwatch(SwatchColor=RGB(255, 0, 0))

custom_preview_17 = CustomPreview(Geometry=divide_curve_2.Points, Material=colour_swatch_3)
custom_curve_preview_3 = CustomCurvePreview(Curve=line_sdl, Linetype=<geometry referenced from the Rhino model>, Colour=colour_swatch_3)
custom_curve_preview_4 = CustomCurvePreview(Curve=line_sdl_2, Linetype=<geometry referenced from the Rhino model>, Colour=colour_swatch_3)
custom_preview_18 = CustomPreview(Geometry=divide_curve.Points, Material=colour_swatch_3)

boundary_internal_offset_2 = Slider(2.85, range=0..20)
negative_2 = Negative(Value=boundary_internal_offset_2)
panel_2 = Panel(boundary_internal_offset_2)
offset_curve_2 = OffsetCurve(Curve=join_curves, Distance=negative_2, Corners=1)
# GRID TYPE SOLVER 1
explode_4 = Explode(Curve=offset_curve_2, Recursive=True)  # -> Segments, Vertices
# Horizontal Axis Curve With a specific offset from the start point
list_item_15 = ListItem(List=explode_4.Segments, Index=Slider(3, range=0..10), Wrap=True)
# Vertical Axis Curve With a specific offset from the start point
list_item_16 = ListItem(List=explode_4.Segments, Index=Slider(6, range=0..10), Wrap=True)
end_points_11 = EndPoints(Curve=list_item_15)  # -> Start, End
end_points_12 = EndPoints(Curve=list_item_16)  # -> Start, End
vector_2pt_3 = Vector2Pt(PointA=end_points_12.Start, PointB=end_points_12.End, Unitize=False)  # -> Vector, Length
vector_2pt_4 = Vector2Pt(PointA=end_points_11.Start, PointB=end_points_11.End, Unitize=False)  # -> Vector, Length
point_11 = Point(end_points_11.Start)
unit_vector_3 = UnitVector(Vector=vector_2pt_4.Vector)
unit_vector_4 = UnitVector(Vector=vector_2pt_3.Vector)
point_12 = Point(end_points_12.End)
contour_11 = Contour(Shape=solved_shape_2, Point=point_11, Direction=unit_vector_3, Distance=grid_span_x_8)
contour_12 = Contour(Shape=solved_shape_2, Point=point_12, Direction=unit_vector_4, Distance=grid_span_y_6)
curve_curve_6 = CurveCurve(CurveA=flatten(contour_11), CurveB=graft(contour_12))  # -> Points, ParamsA, ParamsB
extend_curve_9 = ExtendCurve(Curve=contour_11, Type=0, Start=grid_extension_x_y_directions_2, End=grid_extension_x_y_directions_2)
extend_curve_10 = ExtendCurve(Curve=contour_12, Type=0, Start=grid_extension_x_y_directions_2, End=grid_extension_x_y_directions_2)
colour_swatch_6 = ColourSwatch(SwatchColor=RGB(0, 0, 0))
# Extended Lines
extend_curve_11 = ExtendCurve(Curve=contour_7, Type=0, Start=grid_extension_x_y_directions_4, End=grid_extension_x_y_directions_4)
extend_curve_12 = ExtendCurve(Curve=contour_8, Type=0, Start=grid_extension_x_y_directions_4, End=grid_extension_x_y_directions_4)
ruled_surface = RuledSurface(CurveA=curve_6)
colour_swatch_7 = ColourSwatch(SwatchColor=RGB(255, 0, 0))
custom_preview_19 = CustomPreview(
    Geometry=ruled_surface,
    Material={diffuse=RGB(221, 160, 221), emission=RGB(66, 48, 66), shine=0.5, specular=RGB(255, 255, 255), transparency=0})
colour_swatch_8 = ColourSwatch(SwatchColor=RGB(0, 0, 0))
# Internal Offset Value
boundary_internal_offset_3 = Slider(2.85, range=0..20)
negative_3 = Negative(Value=boundary_internal_offset_3)
panel_3 = Panel(boundary_internal_offset_3)
offset_curve_3 = OffsetCurve(Curve=join_curves_2, Distance=negative_3, Corners=1)
# GRID TYPE SOLVER 1
explode_5 = Explode(Curve=offset_curve_3, Recursive=True)  # -> Segments, Vertices
# Horizontal Axis Curve With a specific offset from the start point
list_item_17 = ListItem(List=explode_5.Segments, Index=Slider(1, range=0..10), Wrap=True)
# Vertical Axis Curve With a specific offset from the start point
list_item_18 = ListItem(List=explode_5.Segments, Index=Slider(4, range=0..10), Wrap=True)
# Specific Initial Offsets to start
# chain of grids across X and Y
end_points_13 = EndPoints(Curve=list_item_17)  # -> Start, End
end_points_14 = EndPoints(Curve=list_item_18)  # -> Start, End
point_13 = Point(end_points_13.Start)
point_14 = Point(end_points_14.End)
contour_13 = Contour(Shape=solved_shape_3, Point=point_13, Direction=unit_x_5, Distance=grid_span_x_9)
contour_14 = Contour(Shape=solved_shape_3, Point=point_14, Direction=unit_y_6, Distance=grid_span_y_7)
curve_curve_7 = CurveCurve(CurveA=flatten(contour_13), CurveB=graft(contour_14))  # -> Points, ParamsA, ParamsB
# Extended Lines
extend_curve_13 = ExtendCurve(Curve=contour_13, Type=0, Start=grid_extension_x_y_directions_3, End=grid_extension_x_y_directions_3)
extend_curve_14 = ExtendCurve(Curve=contour_14, Type=0, Start=grid_extension_x_y_directions_3, End=grid_extension_x_y_directions_3)
colour_swatch_9 = ColourSwatch(SwatchColor=RGB(255, 0, 0))
# Internal Offset Value
boundary_internal_offset_4 = Slider(2.85, range=0..20)
negative_4 = Negative(Value=boundary_internal_offset_4)
panel_4 = Panel(boundary_internal_offset_4)
offset_curve_4 = OffsetCurve(Curve=join_curves_3, Distance=negative_4, Corners=1)
# GRID TYPE SOLVER 1
explode_6 = Explode(Curve=offset_curve_4, Recursive=True)  # -> Segments, Vertices
# Horizontal Axis Curve With a specific offset from the start point
list_item_19 = ListItem(List=explode_6.Segments, Index=Slider(1, range=0..10), Wrap=True)
# Vertical Axis Curve With a specific offset from the start point
list_item_20 = ListItem(List=explode_6.Segments, Index=Slider(4, range=0..10), Wrap=True)
end_points_15 = EndPoints(Curve=list_item_19)  # -> Start, End
end_points_16 = EndPoints(Curve=list_item_20)  # -> Start, End
point_15 = Point(end_points_15.Start)
point_16 = Point(end_points_16.End)
contour_15 = Contour(Shape=solved_shape_4, Point=point_15, Direction=unit_x_6, Distance=grid_span_x_10)
contour_16 = Contour(Shape=solved_shape_4, Point=point_16, Direction=unit_y_7, Distance=grid_span_y_8)
curve_curve_8 = CurveCurve(CurveA=flatten(contour_15), CurveB=graft(contour_16))  # -> Points, ParamsA, ParamsB
extend_curve_15 = ExtendCurve(Curve=contour_15, Type=0, Start=grid_extension_x_y_directions_4, End=grid_extension_x_y_directions_4)
extend_curve_16 = ExtendCurve(Curve=contour_16, Type=0, Start=grid_extension_x_y_directions_4, End=grid_extension_x_y_directions_4)

pipe_3 = Pipe(Curve=[list_item_15, list_item_16], Radius=Slider(0.19, range=0..3), Caps=2)
custom_preview_20 = CustomPreview(Geometry=curve_curve_6.Points, Material=colour_swatch_4)
custom_curve_preview_5 = CustomCurvePreview(Curve=[extend_curve_9, extend_curve_10], Linetype=<geometry referenced from the Rhino model>, Colour=colour_swatch_4)
custom_preview_21 = CustomPreview(Geometry=pipe_3, Material=colour_swatch_4)

pipe_4 = Pipe(Curve=[list_item_5, list_item_8], Radius=Slider(0.13, range=0..3), Caps=2)
custom_preview_22 = CustomPreview(Geometry=pipe_4, Material=colour_swatch_5)
custom_preview_23 = CustomPreview(Geometry=curve_curve_2.Points, Material=colour_swatch_5)
custom_curve_preview_6 = CustomCurvePreview(Curve=[extend_curve_5, extend_curve_6], Linetype=<geometry referenced from the Rhino model>, Colour=colour_swatch_5)

ruled_surface_2 = RuledSurface(CurveA=data)

pipe_5 = Pipe(Curve=[list_item_17, list_item_18], Radius=Slider(0.19, range=0..3), Caps=2)
custom_preview_24 = CustomPreview(Geometry=curve_curve_7.Points, Material=colour_swatch_6)
custom_preview_25 = CustomPreview(Geometry=pipe_5, Material=colour_swatch_6)
custom_curve_preview_7 = CustomCurvePreview(Curve=[extend_curve_13, extend_curve_14], Linetype=<geometry referenced from the Rhino model>, Colour=colour_swatch_6)

pipe_6 = Pipe(Curve=[list_item_9, list_item_10], Radius=Slider(0.13, range=0..3), Caps=2)
custom_preview_26 = CustomPreview(Geometry=pipe_6, Material=colour_swatch_7)
custom_preview_27 = CustomPreview(Geometry=curve_curve_3.Points, Material=colour_swatch_7)
custom_curve_preview_8 = CustomCurvePreview(Curve=[extend_curve_7, extend_curve_8], Linetype=<geometry referenced from the Rhino model>, Colour=colour_swatch_7)

custom_preview_28 = CustomPreview(
    Geometry=ruled_surface_2,
    Material={diffuse=RGB(221, 160, 221), emission=RGB(66, 48, 66), shine=0.5, specular=RGB(255, 255, 255), transparency=0})

pipe_7 = Pipe(Curve=[list_item_19, list_item_20], Radius=Slider(0.19, range=0..3), Caps=2)
custom_preview_29 = CustomPreview(Geometry=curve_curve_8.Points, Material=colour_swatch_8)
custom_preview_30 = CustomPreview(Geometry=pipe_7, Material=colour_swatch_8)
custom_curve_preview_9 = CustomCurvePreview(Curve=[extend_curve_15, extend_curve_16], Linetype=<geometry referenced from the Rhino model>, Colour=colour_swatch_8)

pipe_8 = Pipe(Curve=[list_item_11, list_item_12], Radius=Slider(0.13, range=0..3), Caps=2)
custom_preview_31 = CustomPreview(Geometry=pipe_8, Material=colour_swatch_9)
custom_preview_32 = CustomPreview(Geometry=curve_curve_4.Points, Material=colour_swatch_9)
custom_curve_preview_10 = CustomCurvePreview(Curve=[extend_curve_11, extend_curve_12], Linetype=<geometry referenced from the Rhino model>, Colour=colour_swatch_9)

ruled_surface_3 = RuledSurface(CurveA=_3_01_chopped_built_area_boundary)
custom_preview_33 = CustomPreview(
    Geometry=ruled_surface_3,
    Material={diffuse=RGB(221, 160, 221), emission=RGB(66, 48, 66), shine=0.5, specular=RGB(255, 255, 255), transparency=0})
ruled_surface_4 = RuledSurface(CurveA=data_2)
custom_preview_34 = CustomPreview(
    Geometry=ruled_surface_4,
    Material={diffuse=RGB(221, 160, 221), emission=RGB(66, 48, 66), shine=0.5, specular=RGB(255, 255, 255), transparency=0})
number_slider_8 = Slider(0.4, range=0..5)
number_slider_9 = Slider(0.3, range=0..5)
shatter = Shatter()
negative_5 = Negative(Value=number_slider_9)
negative_6 = Negative(Value=number_slider_8)
construct_domain = ConstructDomain(DomainStart=negative_5, DomainEnd=number_slider_9)
construct_domain_2 = ConstructDomain(DomainStart=negative_6, DomainEnd=number_slider_8)
rectangle = Rectangle(Plane=curve_curve_6.Points, XSize=construct_domain, YSize=construct_domain_2, Radius=Slider(0.04, range=0..5))  # -> Rectangle, Length
surface_closest_point = SurfaceClosestPoint(Point=curve_curve_6.Points, Surface=reparameterize(bounded_shape_2))  # -> Point, UVPoint, Distance
surface_21 = Surface(rectangle.Rectangle)
evaluate_surface = EvaluateSurface(Surface=reparameterize(bounded_shape_2), Point=surface_closest_point.UVPoint)  # -> Point, Normal, UDirection, VDirection, Frame
area = Area(Geometry=surface_21)  # -> Area, Centroid
orient = Orient(Geometry=surface_21, Source=area.Centroid, Target=evaluate_surface.Frame)  # -> Geometry, Transform
custom_preview_35 = CustomPreview(Geometry=orient.Geometry, Material=colour_swatch_4)
